# Grasshopper definition BUILDING_v00.gh (Grasshopper 1.0.7)
# plug-ins: ShapeDiverForGrasshopper, CORE.Toolbox.Grasshopper, Bifocals, MetaHopper, GrasshopperHyperGooComponents

# ----
# EXPORT FOLDER
panel = Panel("Ellipse-Workshop-Exports\")
relative_path = RelativePath(Path=panel)
create_missing_paths = GhPythonScript(path=relative_path)  # -> out, result, path
# ---------- create_missing_paths: Python ----------
__author__ = "NAzel"
__version__ = "2023.09.15"

import rhinoscriptsyntax as rs

import os

def create_directory_if_not_exists(file_path):
    directory = os.path.dirname(file_path)
    directory_status = []
    
    
    components = directory.split(os.path.sep)
    if components[0].endswith(":"):  # Check for Windows drive letter
        components[0] += os.path.sep

    temp_path = components[0]
    
    for component in components[1:]:
        temp_path += component + os.path.sep

        if not os.path.exists(temp_path):
            os.makedirs(temp_path)
            directory_status.append(('created', temp_path.rstrip(os.path.sep)))
        else:
            directory_status.append(('exists', temp_path.rstrip(os.path.sep)))

    # Post-process results to keep only the deepest 'exists'
    result = []
    for i in reversed(range(len(directory_status))):
        if directory_status[i][0] == 'exists':
            result.append(directory_status[i])
            break
        result.append(directory_status[i])
    
    return list(reversed(result))


# Example usage
file_path = path
_path = path
result = create_directory_if_not_exists(file_path)
# ---------- end create_missing_paths ----------

sddp = ShapeDiverDocumentPayload({AbsoluteTolerance=0, AngleTolerance=0, DistanceDisplayPrecision=0, GltfVersion="Gltf2", GrasshopperVersion="1.0.0007", InputGroups="{}", OutputGroups="{}", RelativeTolerance=0, RhinoVersion="7.23.22282.13001", UnitSystem=0, VersionCreated="1.13.0.0", VersionSaved="1.15.0.0"})
c_script = CSharpScript()  # -> out, A
# ---------- c_script: C# ----------
    A = System.IO.Path.GetDirectoryName(GrasshopperDocument.FilePath);
# ---------- end c_script ----------

directory = Panel(create_missing_paths.path)
svg_file_name = Panel("Tower-Svg_Draw_01")
json_file_name = Panel("Tower-Attributes_01")
_3dm_file_name = Panel("Tower-3dm_Model_01")
click_to_save = Button()

facade_offset = Slider(2.245, range=0..10)
column_radius = Slider(0.874, range=0..10)
spacing = Slider(65.51, range=0..100)
count = Slider(10, range=1..20)
mullion_depth = Slider(0.3, range=0..10)
mullion_spacing = Slider(1.5, range=0..10)
core_size = Slider(13.361, range=0..100)
grid_spacing = Slider(11.238, range=0..100)

# ----
# Parametric Tower
# Ellipse Model & Drawings
# Shape to Fabrication
# London, 2023
# Copyright: 2023 CORE studio | Thornton Tomasetti
# Contact: CORE@ThorntonTomasetti.com
# Website: https://www.aectech.us/
panel_2 = Panel("Building Massing")

# ----
# Input Controls
base_radius = Slider(35, range=0..100)
peak_radius = Slider(25, range=0..100)
floor_to_floor = Slider(5, range=3..15)
count_2 = Slider(2.034, range=0..10)
chamfer_low = Slider(0.39, range=0.1..0.9)
chamfer_high = Slider(0.9, range=0.1..0.9)
no_sides = Slider(4, range=3..8)
no_floors = Slider(33, range=10..50)

layer = Panel("Floorplates")
panel_3 = Panel("""Floor Area
Floor Elevation
Floor No.
Program
Elevation
Area
ellipseId
Layer""")

panel_4 = Panel("Save Files")

base_program = Panel("""Lobby
Retail
Retail
Amenity
Mechanical""")
stack_program = Panel("""Office
Office
Office
Office
Office
Office
Office
Office
Office
Mechanical""")
# Add Attributes to Models
top_program = Panel("""Mechanical
Amenity
Amenity
Mechanical""")

panel_5 = Panel("Create Drawings")

# ---- group: Stacked Floorplate Outlines
# Floorplate Outlines
dom = ConstructDomain(DomainStart=base_radius, DomainEnd=peak_radius)
multiplication = Multiplication(A=no_sides, B=2)
subtraction = Subtraction(A=no_floors, B=1)
range = Range(Domain=dom, Steps=subtraction)
range_2 = Range(Domain=Domain(0, 1), Steps=subtraction)
multiplication_2 = Multiplication(A=subtraction, B=floor_to_floor)
polygon = Polygon(Plane=PlaneXY(0, 0, 0), Radius=range, Segments=multiplication, FilletRadius=0)  # -> Polygon, Length
multiplication_3 = Multiplication(A=multiplication_2, B=range_2)
expression = Expression(v=range_2, m=count_2, a=chamfer_low, b=chamfer_high, Expression="a+(Cos(v*m*pi)+1)/2.0*(b-a)")
explode = Explode(Curve=polygon.Polygon, Recursive=True)  # -> Segments, Vertices
shift = ShiftList(List=explode.Segments, Shift=1, Wrap=True)
culln = CullNth(List=explode.Segments, CullFrequency=2)
culln_2 = CullNth(List=shift, CullFrequency=2)
flip = FlipCurve(Curve=culln_2)  # -> Curve, Flag
eval = EvaluateCurve(Curve=reparameterize(culln), Parameter=graft(expression))  # -> simplify(Point), Tangent, Angle
eval_2 = EvaluateCurve(Curve=reparameterize(flip.Curve), Parameter=graft(expression))  # -> simplify(Point), Tangent, Angle
weave = Weave(Pattern=[0, 1], Stream0=eval.Point, Stream1=eval_2.Point, NullGaps=False)
pline = PolyLine(Vertices=weave, Closed=True)  # -> flatten(Polyline)
Z = UnitZ(Factor=multiplication_3)
move = Move(Geometry=pline, Motion=Z)  # -> Geometry, Transform

# ----
colour = Colour(ColourSwatch(SwatchColor=RGB(194, 194, 194)))
unit_z = UnitZ(Factor=floor_to_floor)
gltf_2_0_material = GlTF20Material(
    BaseColorFactor=RGB(255, 255, 255),
    MetallicFactor=0,
    RoughnessFactor=1,
    EmissiveFactor=RGB(0, 0, 0),
    AlphaMode="OPAQUE",
    AlphaCutoff=0.5,
    DoubleSided=True)

# ---- group: Planar Floorplate Surfaces
# Building Surfaces & Volumes
panel_6 = Panel("-1")
toggle = BooleanToggle(False)
shift_2 = ShiftList(List=move.Geometry, Shift=panel_6, Wrap=toggle)  # -> graft(List)
shift_3 = ShiftList(List=move.Geometry, Shift="1", Wrap=toggle)  # -> graft(List)
boundary = BoundarySurfaces(Edges=shift_2)  # -> flatten(Surfaces)
floorplates = Brep(boundary)
floor_perimeters = Curve(flatten(shift_2))

# ----
floors = Curve(floor_perimeters)
c_script_2 = CSharpScript()  # -> Out, Lines
construct_attributes = ConstructAttributes(Keys="Material", Values=gltf_2_0_material)
loft = Loft(
    Curves=[shift_2, shift_3],
    Options={Adjust=False, Closed=False, LoftEnds=0, LoftSimp=0, LoftType=0, Rebuild=10, Refit=0.01})
cap = CapHoles(Brep=loft)  # -> flatten(Brep)
deconstruct_brep = DeconstructBrep(Brep=loft)  # -> Faces, Edges, Vertices
list_item = ListItem(List=flatten(deconstruct_brep.Faces), Index=Slider(86, range=0..100), Wrap=True)
# Attribute Analysis
panel_7 = Panel("Analysis")
floorplates_2 = Brep(flatten(floorplates))

# ---- group: Extract Floorplate Analysis
top_program_2 = Text(top_program)
base_program_2 = Text(base_program)
stack_program_2 = Text(stack_program)
lng = ListLength(List=floorplates_2)
area = Area(Geometry=floorplates_2)  # -> Area, Centroid
lng_2 = ListLength(List=[base_program_2, top_program_2])
subtraction_2 = Subtraction(A=lng, B=lng_2)
series = Series(Start=1, Step=1, Count=lng)
pdecon = Deconstruct(Point=area.Centroid)  # -> XComponent, YComponent, ZComponent
repeat = RepeatData(Data=stack_program_2, Length=subtraction_2)
merge = Merge(Data1=flatten(base_program_2), Data2=flatten(repeat), Data3=flatten(top_program_2))

# ---- group: Floorplates
program = Brep(cap)

# ----
floor = Geometry(program)

# ---- group: Floor Attributes / area
floor_area = Number(area.Area)

# ---- group: Floor Attributes
elevation = Number(pdecon.ZComponent)
floor_number = Number(series)
program_2 = Text(merge)

# ----
elevation_2 = Number(elevation)
floor_number_2 = Number(floor_number)
floor_area_2 = Number(floor_area)
program_3 = Text(program_2)

param_viewer = ParamViewer(floor_number)

floor_2 = Geometry(program)

# ---- group: Add Attributes to Model
# Build Attributes Per Floor
lng_3 = ListLength(List=floor)
guids = CreateGuids(Count=lng_3)
concat = Concatenate(FragmentA="e-", FragmentB=guids)  # -> simplify(graft(Result))
preview = CustomPreview(Geometry=floor, Material=colour)

# ----
dup = DuplicateData(Data=layer, Number=lng_3, Order=True)

# ---- group: Add Attributes to Model (continued)
merge_2 = Merge(
    Data1=simplify(graft(floor_area_2)),
    Data2=simplify(graft(elevation_2)),
    Data3=simplify(graft(floor_number_2)),
    Data4=simplify(graft(program_3)),
    Data5=simplify(graft(elevation_2)),
    Data6=simplify(graft(floor_area_2)),
    Data7=simplify(graft(concat)),
    Data8=simplify(graft(dup)))
attributes = ConstructAttributes(Name=concat, Layer=layer, Groups=concat, Keys=panel_3, Values=merge_2)  # -> simplify(Attribute)
set_material = SetMaterial(Attribute=flatten(attributes), DiffuseColor=colour, Roughness="0.95", Metalness="0.1", Opacity="1.0")
data = Data(flatten(attributes))
bake_attr = BakeAttributes(Geometry=floor, Attribute=set_material)

# ---- group: Generate Drawings
floor_plan_maker = FloorPlanMaker(
    floor_perimeters=floors,
    spacing=spacing,
    count=count,
    mullion_depth=mullion_depth,
    mullion_spacing=mullion_spacing,
    core_size=core_size,
    grid_spacing=grid_spacing,
    facade_offset=facade_offset,
    column_radius=column_radius)  # -> geometry, geometry_2, geometry_3, geometry_4, geometry_5, geometry_6
merge_3 = Merge(Data1=simplify(floor_plan_maker.geometry), Data3=simplify(floor_plan_maker.geometry_6))  # -> simplify(Result)
horizontal_mullions = Curve(simplify(floor_plan_maker.geometry_3))
horizontal_mullions_2 = Curve(simplify(floor_plan_maker.geometry_4))
grid = Curve(simplify(floor_plan_maker.geometry_5))
data_2 = Data(attributes)

# ----
panel_8 = Panel(merge_2)
area_2 = Area(Geometry=floor_plan_maker.geometry_6)  # -> Area, Centroid

# ----
# Split At Intersections
panel_9 = Panel("25")
c_script_3 = CSharpScript(Curves=grid, dTol=panel_9)  # -> out, Split; inputs Curves: tree of Curve, dTol: Double
# ---------- c_script_3: C# ----------
    var lines = ProcessCurves(Curves, dTol);
    Split = lines;
# ---------- c_script_3: C# additional code ----------
  public static DataTree<Line> ProcessCurves(DataTree<Curve> curvesTree, double dTol)
  {
    List<Curve> allCurves = new List<Curve>();
    Dictionary<Curve, GH_Path> curveToPathMap = new Dictionary<Curve, GH_Path>();

    foreach (GH_Path path in curvesTree.Paths)
    {
      List<Curve> branchCurves = curvesTree.Branch(path);
      allCurves.AddRange(branchCurves);
      foreach (var curve in branchCurves)
      {
        curveToPathMap[curve] = path;
      }
    }

    // Convert curves to polylines based on the dTol
    List<Polyline> polylines = new List<Polyline>();
    foreach (var curve in allCurves)
    {
      Polyline polyline;
      if (curve.TryGetPolyline(out polyline))
      {
        polylines.Add(polyline);
      }
      else
      {
        var parameters = curve.DivideByLength(dTol, true);
        if (parameters != null)
        {
          curve.ToPolyline(0, 0, 0, dTol).TryGetPolyline(out polyline);
          polylines.Add(polyline);
        }
      }
    }

    // Split curves at intersections
    List<Curve> splittedCurves = new List<Curve>();
    for (int i = 0; i < polylines.Count; i++)
    {
      Curve curveToSplit = polylines[i].ToNurbsCurve();
      List<double> splitParameters = new List<double>();

      for (int j = 0; j < polylines.Count; j++)
      {
        if (i != j)
        {
          var intersections = Rhino.Geometry.Intersect.Intersection.CurveCurve(curveToSplit, polylines[j].ToNurbsCurve(), 0.01, 0.01);
          foreach (var intersection in intersections)
          {
            if (intersection.IsOverlap)
            {
              var overlapSegment = intersection.OverlapA;
              splitParameters.Add(overlapSegment.T0);
              splitParameters.Add(overlapSegment.T1);
            }
            else
            {
              splitParameters.Add(intersection.ParameterA);
            }
          }
        }
      }

      splittedCurves.AddRange(curveToSplit.Split(splitParameters));
    }

    // Convert the resulting split curves into lines
    List<Line> resultLines = new List<Line>();
    foreach (var curve in splittedCurves)
    {
      Polyline polyline;
      if (curve.TryGetPolyline(out polyline))
      {
        for (int i = 0; i < polyline.SegmentCount; i++)
        {
          resultLines.Add(polyline.SegmentAt(i));
        }
      }
    }

    DataTree<Line> resultLinesTree = new DataTree<Line>();
    foreach (var line in resultLines)
    {
      Curve closestCurve = null;
      double closestDist = double.MaxValue;

      foreach (var curve in allCurves)
      {
        var point = 0.5 * line.From + 0.5 * line.To;
        double t;
        curve.ClosestPoint(point, out t);
        var cp = curve.PointAt(t);
        var dist = cp.DistanceTo(point);
        if (dist < closestDist)
        {
          closestDist = dist;
          closestCurve = curve;
        }
      }

      if (closestCurve != null)
      {
        var path = curveToPathMap[closestCurve];
        resultLinesTree.Add(line, path);
      }
    }

    return resultLinesTree;
  }
# ---------- end c_script_3 ----------
curve = Curve(c_script_3.Split)

move_2 = Move(Geometry=area_2.Centroid, Motion=unit_z)  # -> Geometry, Transform
line = Line(StartPoint=area_2.Centroid, EndPoint=move_2.Geometry)
merge_4 = Merge(Data1=curve, Data2=line)  # -> flatten(Result)
end_points = EndPoints(Curve=merge_4)  # -> Start, End
core_attr_data = Data(data)
attr_data = Data(core_attr_data)
core_attr_model = Data(set_material)

attr_mdl = Data(core_attr_model)

inject_attributes = InjectAttributes(Object=merge_4, Attributes=construct_attributes)
gltf_2_0_display = GlTF20Display(Geometry=inject_attributes)

# ---- group: Assemble Drawing Attributes & Graphics
# Add Style Attribute To 2D lines
merge_5 = Merge(Data1=merge_3, Data2=horizontal_mullions, Data3=horizontal_mullions_2, Data4=grid)  # -> flatten(Result)
panel_10 = Panel("""10
10""")
set_graphic = SetGraphics(
    Attribute=data_2,
    StrokeColor=ColourSwatch(SwatchColor=RGB(0, 0, 0)),
    StrokeWeight="2",
    ObjectColor=ColourSwatch(SwatchColor=RGB(0, 0, 0)))
set_graphic_2 = SetGraphics(
    Attribute=data_2,
    StrokeColor=ColourSwatch(SwatchColor=RGB(0, 0, 0)),
    StrokeWeight="2",
    ObjectColor=ColourSwatch(SwatchColor=RGBA(0, 0, 0, 0)))
set_graphic_3 = SetGraphics(
    Attribute=data_2,
    StrokeColor=ColourSwatch(SwatchColor=RGB(0, 0, 0)),
    StrokeWeight="1",
    ObjectColor=ColourSwatch(SwatchColor=RGBA(0, 0, 0, 0)))
set_graphic_4 = SetGraphics(
    Attribute=data_2,
    StrokeColor=ColourSwatch(SwatchColor=RGB(0, 0, 0)),
    StrokeWeight="1",
    StrokePattern=panel_10,
    ObjectColor=ColourSwatch(SwatchColor=RGBA(0, 0, 0, 0)))
lng_4 = ListLength(List=merge_3)
lng_5 = ListLength(List=horizontal_mullions_2)
lng_6 = ListLength(List=horizontal_mullions)
lng_7 = ListLength(List=grid)
tree_branch = TreeBranch(Tree=merge_3, Path=Slider(2, range=0..10), MaintainPaths=True)
dup_2 = DuplicateData(Data=set_graphic, Number=lng_4, Order=True)  # -> simplify(Data)
dup_3 = DuplicateData(Data=set_graphic_2, Number=lng_6, Order=True)  # -> simplify(Data)
dup_4 = DuplicateData(Data=set_graphic_3, Number=lng_5, Order=True)  # -> simplify(Data)
dup_5 = DuplicateData(Data=set_graphic_4, Number=lng_7, Order=True)  # -> simplify(Data)
merge_6 = Merge(Data1=dup_2, Data2=dup_3, Data3=dup_4, Data4=dup_5)  # -> flatten(Result)
plans = Curve(merge_5)

# ----
plans_2 = Curve(plans)
core_attr_drawing = Data(merge_6)

plans_3 = Curve(plans_2)
attr_dwg = Data(core_attr_drawing)

# ---- group: Save to Files
svg_out = ExportSVG(Geometry=plans_3, Attributes=attr_dwg, DirectoryPath=directory, FileName=svg_file_name, Save=click_to_save)
_3dm_out = Export3DM(Geometries=floor_2, Attributes=attr_mdl, DirectoryPath=directory, FileName=_3dm_file_name, Version=7, Save=click_to_save)
save_attr = SaveAttributes(Attributes=attr_data, DirectoryPath=directory, FileName=json_file_name, Format=0, Save=click_to_save)

# ==== cluster FloorPlanMaker
floor_perimeters = ClusterInput()
mullion_spacing = ClusterInput()
mullion_depth = ClusterInput()
column_radius = ClusterInput()
facade_offset = ClusterInput()
grid_spacing = ClusterInput()
spacing = ClusterInput()
core_size = ClusterInput()
count = ClusterInput()
floor_perimeters_2 = Curve(floor_perimeters)
mullion_spacing_2 = Number(mullion_spacing)
mullion_depth_2 = Number(mullion_depth)
facade_offset_2 = Number(facade_offset)
grid_spacing_2 = Number(grid_spacing)
column_radius_2 = Number(column_radius)
spacing_2 = Number(spacing)
core_size_2 = Number(core_size)
count_2 = Number(count)
lng = ListLength(List=floor_perimeters_2)
neg = Negative(Value=mullion_depth_2)
neg_2 = Negative(Value=facade_offset_2)
vec = VectorXYZ(XComponent=spacing_2, YComponent=spacing_2, ZComponent=0)  # -> Vector, Length
division = Division(A=lng, B=count_2)
sqgrid = Square(Plane=vec.Vector, Size=spacing_2, ExtentX=count_2, ExtentY=division)  # -> Cells, flatten(Points)
short = ShortestList(ListA=floor_perimeters_2, ListB=sqgrid.Points, TrimMode=2)  # -> graft(ListA), graft(ListB)
move = Move(Geometry=short.ListA, Motion=short.ListB)  # -> Geometry, Transform
pt = Point(short.ListB)
crv = Curve(move.Geometry)
project = Project(Geometry=crv, Plane=pt)  # -> Geometry, Transform
division_2 = Division(A=core_size_2, B=2)
xy = XYPlane(Origin=pt)
crv_2 = Curve(reparameterize(project.Geometry))
neg_3 = Negative(Value=division_2)
dom = ConstructDomain(DomainStart=neg_3, DomainEnd=division_2)
explode = Explode(Curve=crv_2, Recursive=True)  # -> reparameterize(graft(Segments)), Vertices
division_3 = Division(A=mullion_depth_2, B=4)
offset = OffsetCurve(Curve=crv_2, Distance=neg, Corners=1)
rectangle = Rectangle(Plane=xy, XSize=dom, YSize=dom, Radius=0)  # -> Rectangle, Length
divlenfrom = DivideLengthFrom(Curve=explode.Segments, Length=mullion_spacing_2, Parameter="0.5")  # -> Points, Tangents, simplify(Parameters)
boundrect = BoundingRectangle(Geometry=crv_2, Plane=PlaneXY(0, 0, 0), unioned=False)
neg_4 = Negative(Value=division_3)
drec = DeconstuctRectangle(Rectangle=boundrect)  # -> BasePlane, XInterval, YInterval
hframe = HorizontalFrame(Curve=explode.Segments, Parameter=divlenfrom.Parameters)
dom_2 = ConstructDomain(DomainStart=neg_4, DomainEnd=division_3)
offset_2 = OffsetCurve(Curve=boundrect, Distance=facade_offset_2, Corners=1)
rectangle_2 = Rectangle(Plane=hframe, XSize=dom_2, YSize=mullion_depth_2, Radius=0)  # -> simplify(Rectangle), Length
cluster = Cluster(I=drec.XInterval, B=grid_spacing_2)  # -> R, y
cluster_2 = Cluster(I=drec.YInterval, B=grid_spacing_2)  # -> R, y
pshift = ShiftPaths(Data=rectangle_2.Rectangle, Offset=-1)
int = Integer(cluster.R)
int_2 = Integer(cluster_2.R)
vec_2 = VectorXYZ(XComponent=cluster.y, YComponent=cluster_2.y, ZComponent=0)  # -> simplify(Vector), Length
sqgrid_2 = Square(Plane=pt, Size=grid_spacing_2, ExtentX=int, ExtentY=int_2)  # -> Cells, simplify(Points)
move_2 = Move(Geometry=sqgrid_2.Points, Motion=vec_2.Vector)  # -> simplify(Geometry), Transform
path_mapper = PathMapper(sqgrid_2.Points, source="{A;B}(C)", target="{A;C}(B)")
pline = PolyLine(Vertices=path_mapper, Closed=False)
pline_2 = PolyLine(Vertices=sqgrid_2.Points, Closed=False)
offset_3 = OffsetCurve(Curve=crv_2, Distance=neg_2, Corners=1)  # -> simplify(Curve)
pshift_2 = ShiftPaths(Data=pline, Offset=-1)
pshift_3 = ShiftPaths(Data=pline_2, Offset=-1)
move_3 = Move(Geometry=pshift_2, Motion=vec_2.Vector)  # -> simplify(Geometry), Transform
move_4 = Move(Geometry=pshift_3, Motion=vec_2.Vector)  # -> simplify(Geometry), Transform
pshift_4 = ShiftPaths(Data=move_2.Geometry, Offset=-1)
boundary = BoundarySurfaces(Edges=offset_2)
boundary_2 = BoundarySurfaces(Edges=offset_3)
incurve = PointInCurve(Point=pshift_4, Curve=offset_3)  # -> Relationship, Point
project_2 = Project(Curve=move_4.Geometry, Brep=boundary, Direction=Vector(0, 0, 1))  # -> simplify(Curve)
project_3 = Project(Curve=move_3.Geometry, Brep=boundary, Direction=Vector(0, 0, 1))  # -> simplify(Curve)
panel = Panel("""0
-1""")
panel_2 = Panel("""0
-1""")
cull_i = CullIndex(List=move_4.Geometry, Indices=panel, Wrap=True)
cull_i_2 = CullIndex(List=move_3.Geometry, Indices=panel_2, Wrap=True)
dispatch = Dispatch(List=incurve.Point, DispatchPattern=incurve.Relationship)  # -> ListA, ListB
project_4 = Project(Curve=cull_i_2, Brep=boundary_2, Direction=Vector(0, 0, 1))
project_5 = Project(Curve=cull_i, Brep=boundary_2, Direction=Vector(0, 0, 1))
pshift_5 = ShiftPaths(Data=project_5, Offset=-1)  # -> simplify(Data)
pshift_6 = ShiftPaths(Data=project_4, Offset=-1)  # -> simplify(Data)
pshift_7 = ShiftPaths(Data=project_4, Offset=-1)  # -> simplify(Data)
pshift_8 = ShiftPaths(Data=project_5, Offset=-1)  # -> simplify(Data)
end = EndPoints(Curve=pshift_6)  # -> Start, End
end_2 = EndPoints(Curve=pshift_5)  # -> Start, End
pt_2 = Point([end_2.Start, end_2.End, dispatch.ListA, end.Start, end.End])
crv_3 = Curve([pshift_8, pshift_7, offset_3])
cir = Circle(Plane=pt_2, Radius=column_radius_2)
core = Curve(rectangle.Rectangle)
vertical_mullions = Curve(pshift)
horizontal_mullions = Curve(offset)
glazing = Curve(crv_2)
grid = Curve(crv_3)
columns = Curve(cir)
area = Area(Geometry=floor_perimeters_2)  # -> Area, Centroid
curve = EleFrontDataDescription(core, ShiftDepth=0, isNameSet=False)
curve_2 = EleFrontDataDescription(vertical_mullions, ShiftDepth=0, isNameSet=False)
curve_3 = EleFrontDataDescription(horizontal_mullions, ShiftDepth=0, isNameSet=False)
curve_4 = EleFrontDataDescription(glazing, ShiftDepth=0, isNameSet=False)
curve_5 = EleFrontDataDescription(grid, ShiftDepth=0, isNameSet=False)
curve_6 = EleFrontDataDescription(columns, ShiftDepth=0, isNameSet=False)
point = Point(graft(area.Centroid))
curve_7 = EleFrontDataDescription(core, ShiftDepth=0, isNameSet=False)
curve_8 = EleFrontDataDescription(vertical_mullions, ShiftDepth=0, isNameSet=False)
curve_9 = EleFrontDataDescription(horizontal_mullions, ShiftDepth=0, isNameSet=False)
curve_10 = EleFrontDataDescription(glazing, ShiftDepth=0, isNameSet=False)
curve_11 = EleFrontDataDescription(grid, ShiftDepth=0, isNameSet=False)
curve_12 = EleFrontDataDescription(columns, ShiftDepth=0, isNameSet=False)
area_2 = Area(Geometry=curve_10)  # -> Area, Centroid
vector_2pt = Vector2Pt(PointA=area_2.Centroid, PointB=point, Unitize=False)  # -> Vector, Length
move_5 = Move(Geometry=curve_7, Motion=vector_2pt.Vector)  # -> Geometry, Transform
move_6 = Move(Geometry=curve_8, Motion=vector_2pt.Vector)  # -> Geometry, Transform
move_7 = Move(Geometry=curve_9, Motion=vector_2pt.Vector)  # -> Geometry, Transform
move_8 = Move(Geometry=curve_10, Motion=vector_2pt.Vector)  # -> Geometry, Transform
move_9 = Move(Geometry=curve_11, Motion=vector_2pt.Vector)  # -> Geometry, Transform
move_10 = Move(Geometry=curve_12, Motion=vector_2pt.Vector)  # -> Geometry, Transform
scale = Scale(Geometry=curve_5, Center=Point(0, 0, 0), Factor="10")  # -> Geometry, Transform
scale_2 = Scale(Geometry=curve_3, Center=Point(0, 0, 0), Factor="10")  # -> Geometry, Transform
scale_3 = Scale(Geometry=curve_4, Center=Point(0, 0, 0), Factor="10")  # -> Geometry, Transform
scale_4 = Scale(Geometry=curve_2, Center=Point(0, 0, 0), Factor="10")  # -> Geometry, Transform
scale_5 = Scale(Geometry=curve, Center=Point(0, 0, 0), Factor="10")  # -> Geometry, Transform
scale_6 = Scale(Geometry=curve_6, Center=Point(0, 0, 0), Factor="10")  # -> Geometry, Transform
horizontal_mullions_2 = Curve(scale_2.Geometry)
vertical_mullions_2 = Curve(scale_4.Geometry)
columns_2 = Curve(scale_6.Geometry)
core_2 = Curve(scale_5.Geometry)
grid_2 = Curve(scale.Geometry)
glazing_2 = Curve(scale_3.Geometry)
geometry = ClusterOutput(move_5.Geometry)
geometry_2 = ClusterOutput(move_6.Geometry)
geometry_3 = ClusterOutput(move_7.Geometry)
geometry_4 = ClusterOutput(move_8.Geometry)
geometry_5 = ClusterOutput(move_9.Geometry)
geometry_6 = ClusterOutput(move_10.Geometry)

# ==== cluster Cluster
I = ClusterInput()
B = ClusterInput()
ded = DeconstructDomain(Domain=I)  # -> Start, End
subtraction = Subtraction(A=ded.End, B=ded.Start)
division = Division(A=B, B=2)
division_2 = Division(A=subtraction, B=B)
division_3 = Division(A=division_2, B=2)
round = Round(Number=division_3)  # -> Nearest, Floor, Ceiling
addition = Addition(A=round.Floor, B=1)
multiplication = Multiplication(A=addition, B=2)
addition_2 = Addition(A=multiplication, B=1)
multiplication_2 = Multiplication(A=addition_2, B=division)
neg = Negative(Value=multiplication_2)
y = ClusterOutput(neg)
R = ClusterOutput(addition_2)
