# Grasshopper definition BUILDING_v01.gh (Grasshopper 1.0.7)
# plug-ins: ShapeDiverForGrasshopper, CORE.Toolbox.Grasshopper, GrasshopperHyperGooComponents, eleFront

base_radius = Slider(83, range=60..200)
no_floors = Slider(48, range=10..50)
floor_to_floor = Slider(12, range=8..15)

sddp = ShapeDiverDocumentPayload({AbsoluteTolerance=0, AngleTolerance=0, DistanceDisplayPrecision=0, GltfVersion="Gltf2", GrasshopperVersion="1.0.0007", InputGroups="{}", OutputGroups="{}", RelativeTolerance=0, RhinoVersion="7.23.22282.13001", UnitSystem=0, VersionCreated="1.13.0.0", VersionSaved="1.15.0.0"})

# ----
# Other Controls
no_sides = Slider(3, range=3..8)
count = Slider(2, range=0..10)
chamfer_high = Slider(0.9, range=0.1..0.9)
peak_radius = Slider(60, range=60..100)
chamfer_low = Slider(0.5, range=0.1..0.9)

base_program = Panel("""Lobby
Retail
Retail
Amenity
Mechanical""")
stack_program = Panel("""Office
Office
Office
Office
Office
Office
Office
Office
Office
Mechanical""")
# Add Attributes to Models
top_program = Panel("""Mechanical
Amenity
Amenity
Mechanical""")

column_radius = Slider(1, range=0..10)
spacing = Slider(65, range=0..100)
mullion_spacing = Slider(1.5, range=0..10)
core_size = Slider(14, range=0..100)
grid_spacing = Slider(15, range=15..25)
facade_offset = Slider(0, range=0..10)
count_2 = Slider(10, range=1..20)
mullion_depth = Slider(0.3, range=0..10)

# ----
# Parametric Tower
# Ellipse Model & Drawings
# Shape to Fabrication
# London, 2023
# Copyright: 2023 CORE studio | Thornton Tomasetti
# Contact: CORE@ThorntonTomasetti.com
# Website: https://www.aectech.us/
panel = Panel("Building Massing")

layer = Panel("Floorplates")
panel_2 = Panel("""Floor Area
Floor Elevation
Floor No.
Program
Elevation
Area
ellipseId
Layer""")

panel_3 = Panel("Create Drawings")

# ---- group: Stacked Floorplate Outlines
# Floorplate Outlines
dom = ConstructDomain(DomainStart=base_radius, DomainEnd=peak_radius)
multiplication = Multiplication(A=no_sides, B=2)
subtraction = Subtraction(A=no_floors, B=1)
range = Range(Domain=dom, Steps=subtraction)
range_2 = Range(Domain=Domain(0, 1), Steps=subtraction)
multiplication_2 = Multiplication(A=subtraction, B=floor_to_floor)
polygon = Polygon(Plane=PlaneXY(0, 0, 0), Radius=range, Segments=multiplication, FilletRadius=0)  # -> Polygon, Length
multiplication_3 = Multiplication(A=multiplication_2, B=range_2)
expression = Expression(v=range_2, m=count, a=chamfer_low, b=chamfer_high, Expression="a+(Cos(v*m*pi)+1)/2.0*(b-a)")
explode = Explode(Curve=polygon.Polygon, Recursive=True)  # -> Segments, Vertices
shift = ShiftList(List=explode.Segments, Shift=1, Wrap=True)
culln = CullNth(List=explode.Segments, CullFrequency=2)
culln_2 = CullNth(List=shift, CullFrequency=2)
flip = FlipCurve(Curve=culln_2)  # -> Curve, Flag
eval = EvaluateCurve(Curve=reparameterize(culln), Parameter=graft(expression))  # -> simplify(Point), Tangent, Angle
eval_2 = EvaluateCurve(Curve=reparameterize(flip.Curve), Parameter=graft(expression))  # -> simplify(Point), Tangent, Angle
weave = Weave(Pattern=[0, 1], Stream0=eval.Point, Stream1=eval_2.Point, NullGaps=False)
pline = PolyLine(Vertices=weave, Closed=True)  # -> flatten(Polyline)
Z = UnitZ(Factor=multiplication_3)
move = Move(Geometry=pline, Motion=Z)  # -> Geometry, Transform

# ----
number_slider = Slider(5, range=0..10)  # disabled
colour = Colour(ColourSwatch(SwatchColor=RGB(194, 194, 194)))
unit_z = UnitZ(Factor=floor_to_floor)
gltf_2_0_material = GlTF20Material(
    BaseColorFactor=RGB(255, 255, 255),
    MetallicFactor=0,
    RoughnessFactor=1,
    EmissiveFactor=RGB(0, 0, 0),
    AlphaMode="OPAQUE",
    AlphaCutoff=0.5,
    DoubleSided=True)

# ---- group: Planar Floorplate Surfaces
# Building Surfaces & Volumes
panel_4 = Panel("-1")
toggle = BooleanToggle(False)
shift_2 = ShiftList(List=move.Geometry, Shift=panel_4, Wrap=toggle)  # -> graft(List)
shift_3 = ShiftList(List=move.Geometry, Shift="1", Wrap=toggle)  # -> graft(List)
boundary = BoundarySurfaces(Edges=shift_2)  # -> flatten(Surfaces)
floorplates = Brep(boundary)
floor_perimeters = Curve(flatten(shift_2))

# ----
floors = Curve(floor_perimeters)
construct_attributes = ConstructAttributes(Keys="Material", Values=gltf_2_0_material)
loft = Loft(
    Curves=[shift_2, shift_3],
    Options={Adjust=False, Closed=False, LoftEnds=0, LoftSimp=0, LoftType=0, Rebuild=10, Refit=0.01})
cap = CapHoles(Brep=loft)  # -> flatten(Brep)
deconstruct_brep = DeconstructBrep(Brep=loft)  # -> Faces, Edges, Vertices
geometry = Geometry(flatten(deconstruct_brep.Faces))
list_item = ListItem(List=flatten(deconstruct_brep.Faces), Index=Slider(86, range=0..100), Wrap=True)
# Attribute Analysis
panel_5 = Panel("Analysis")
floorplates_2 = Brep(flatten(floorplates))

# ---- group: Extract Floorplate Analysis
top_program_2 = Text(top_program)
base_program_2 = Text(base_program)
stack_program_2 = Text(stack_program)
lng = ListLength(List=floorplates_2)
area = Area(Geometry=floorplates_2)  # -> Area, Centroid
lng_2 = ListLength(List=[base_program_2, top_program_2])
subtraction_2 = Subtraction(A=lng, B=lng_2)
series = Series(Start=1, Step=1, Count=lng)
pdecon = Deconstruct(Point=area.Centroid)  # -> XComponent, YComponent, ZComponent
repeat = RepeatData(Data=stack_program_2, Length=subtraction_2)
merge = Merge(Data1=flatten(base_program_2), Data2=flatten(repeat), Data3=flatten(top_program_2))

# ---- group: Floorplates
program = Brep(cap)

# ----
floor = Geometry(program)

# ---- group: Floor Attributes
elevation = Number(pdecon.ZComponent)
floor_number = Number(series)
program_2 = Text(merge)

# ---- group: Floor Attributes / area
floor_area = Number(area.Area)

# ----
elevation_2 = Number(elevation)
floor_number_2 = Number(floor_number)
floor_area_2 = Number(floor_area)
program_3 = Text(program_2)

param_viewer = ParamViewer(floor_number)

directory = Panel("")  # disabled
svg_file_name = Panel("Tower-Svg_Draw_01")  # disabled
_3dm_file_name = Panel("Tower-3dm_Model_01")  # disabled
json_file_name = Panel("Tower-Attributes_01")  # disabled
click_to_save = Button()  # disabled

panel_6 = Panel("Save Files")

# ---- group: FACES
geometry_2 = Geometry(geometry)

# ---- group: Add Attributes to Model
# Build Attributes Per Floor
lng_3 = ListLength(List=floor)
guids = CreateGuids(Count=lng_3)
concat = Concatenate(FragmentA="e-", FragmentB=guids)  # -> simplify(graft(Result))
preview = CustomPreview(Geometry=floor, Material=colour)

# ----
dup = DuplicateData(Data=layer, Number=lng_3, Order=True)

# ---- group: Add Attributes to Model (continued)
merge_2 = Merge(
    Data1=simplify(graft(floor_area_2)),
    Data2=simplify(graft(elevation_2)),
    Data3=simplify(graft(floor_number_2)),
    Data4=simplify(graft(program_3)),
    Data5=simplify(graft(elevation_2)),
    Data6=simplify(graft(floor_area_2)),
    Data7=simplify(graft(concat)),
    Data8=simplify(graft(dup)))
attributes = ConstructAttributes(Name=concat, Layer=layer, Groups=concat, Keys=panel_2, Values=merge_2)  # -> simplify(Attribute)
set_material = SetMaterial(Attribute=flatten(attributes), DiffuseColor=colour, Roughness="0.95", Metalness="0.1", Opacity="1.0")
data = Data(flatten(attributes))
bake_attr = BakeAttributes(Geometry=floor, Attribute=set_material)

# ---- group: Generate Drawings
floor_plan_maker = FloorPlanMaker(
    floor_perimeters=floors,
    spacing=spacing,
    count=count_2,
    mullion_depth=mullion_depth,
    mullion_spacing=mullion_spacing,
    core_size=core_size,
    grid_spacing=grid_spacing,
    facade_offset=facade_offset,
    column_radius=column_radius)  # -> geometry, geometry_2, geometry_3, geometry_4, geometry_5, geometry_6
merge_3 = Merge(Data1=simplify(floor_plan_maker.geometry), Data3=simplify(floor_plan_maker.geometry_6))  # -> simplify(Result)
horizontal_mullions = Curve(simplify(floor_plan_maker.geometry_3))
horizontal_mullions_2 = Curve(simplify(floor_plan_maker.geometry_4))
grid = Curve(simplify(floor_plan_maker.geometry_5))
data_2 = Data(attributes)

# ----
panel_7 = Panel(merge_2)
area_2 = Area(Geometry=floor_plan_maker.geometry_6)  # -> Area, Centroid

# ----
# Split At Intersections
panel_8 = Panel("25")
c_script = CSharpScript(Curves=grid, dTol=panel_8)  # -> out, Split; inputs Curves: tree of Curve, dTol: Double
# ---------- c_script: C# ----------
    var lines = ProcessCurves(Curves, dTol);
    Split = lines;
# ---------- c_script: C# additional code ----------
  public static DataTree<Line> ProcessCurves(DataTree<Curve> curvesTree, double dTol)
  {
    List<Curve> allCurves = new List<Curve>();
    Dictionary<Curve, GH_Path> curveToPathMap = new Dictionary<Curve, GH_Path>();

    foreach (GH_Path path in curvesTree.Paths)
    {
      List<Curve> branchCurves = curvesTree.Branch(path);
      allCurves.AddRange(branchCurves);
      foreach (var curve in branchCurves)
      {
        curveToPathMap[curve] = path;
      }
    }

    // Convert curves to polylines based on the dTol
    List<Polyline> polylines = new List<Polyline>();
    foreach (var curve in allCurves)
    {
      Polyline polyline;
      if (curve.TryGetPolyline(out polyline))
      {
        polylines.Add(polyline);
      }
      else
      {
        var parameters = curve.DivideByLength(dTol, true);
        if (parameters != null)
        {
          curve.ToPolyline(0, 0, 0, dTol).TryGetPolyline(out polyline);
          polylines.Add(polyline);
        }
      }
    }

    // Split curves at intersections
    List<Curve> splittedCurves = new List<Curve>();
    for (int i = 0; i < polylines.Count; i++)
    {
      Curve curveToSplit = polylines[i].ToNurbsCurve();
      List<double> splitParameters = new List<double>();

      for (int j = 0; j < polylines.Count; j++)
      {
        if (i != j)
        {
          var intersections = Rhino.Geometry.Intersect.Intersection.CurveCurve(curveToSplit, polylines[j].ToNurbsCurve(), 0.01, 0.01);
          foreach (var intersection in intersections)
          {
            if (intersection.IsOverlap)
            {
              var overlapSegment = intersection.OverlapA;
              splitParameters.Add(overlapSegment.T0);
              splitParameters.Add(overlapSegment.T1);
            }
            else
            {
              splitParameters.Add(intersection.ParameterA);
            }
          }
        }
      }

      splittedCurves.AddRange(curveToSplit.Split(splitParameters));
    }

    // Convert the resulting split curves into lines
    List<Line> resultLines = new List<Line>();
    foreach (var curve in splittedCurves)
    {
      Polyline polyline;
      if (curve.TryGetPolyline(out polyline))
      {
        for (int i = 0; i < polyline.SegmentCount; i++)
        {
          resultLines.Add(polyline.SegmentAt(i));
        }
      }
    }

    DataTree<Line> resultLinesTree = new DataTree<Line>();
    foreach (var line in resultLines)
    {
      Curve closestCurve = null;
      double closestDist = double.MaxValue;

      foreach (var curve in allCurves)
      {
        var point = 0.5 * line.From + 0.5 * line.To;
        double t;
        curve.ClosestPoint(point, out t);
        var cp = curve.PointAt(t);
        var dist = cp.DistanceTo(point);
        if (dist < closestDist)
        {
          closestDist = dist;
          closestCurve = curve;
        }
      }

      if (closestCurve != null)
      {
        var path = curveToPathMap[closestCurve];
        resultLinesTree.Add(line, path);
      }
    }

    return resultLinesTree;
  }
# ---------- end c_script ----------
curve = Curve(c_script.Split)

move_2 = Move(Geometry=area_2.Centroid, Motion=unit_z)  # -> Geometry, Transform
line = Line(StartPoint=area_2.Centroid, EndPoint=move_2.Geometry)
merge_4 = Merge(Data1=curve, Data2=line)  # -> flatten(Result)
c_script_2 = CSharpScript(lines=merge_4, tol=number_slider)  # -> out, Lines; inputs lines: list of Line, tol: Double; disabled
# ---------- c_script_2: C# ----------
    // Update the class-level threshold
    var _threshold = tol;

    // Process the lines
    List<Line> snappedLines = SnapLineEndpoints(lines, _threshold);

    // Set the output parameter
    Lines = snappedLines;
# ---------- c_script_2: C# additional code ----------
  private List<Line> SnapLineEndpoints(List<Line> lines, double threshold)
  {
    // Dictionary to keep track of unique endpoints and their corresponding lines
    var uniqueEndpoints = new Dictionary<Point3d, Line>();

    // Go through each line and determine if its endpoints are unique
    foreach (var line in lines)
    {
      // Check uniqueness of start point
      if (!IsSharedEndpoint(line.From, lines, threshold))
      {
        uniqueEndpoints[line.From] = line;
      }
      // Check uniqueness of end point
      if (!IsSharedEndpoint(line.To, lines, threshold))
      {
        uniqueEndpoints[line.To] = line;
      }
    }

    // Now, adjust lines to snap to the nearest unique endpoint
    var snappedLines = new List<Line>();
    foreach (var line in lines)
    {
      var newStart = line.From;
      var newEnd = line.To;

      // Snap start point if it's unique and within threshold of another unique point
      if (uniqueEndpoints.ContainsKey(line.From))
      {
        foreach (var endpoint in uniqueEndpoints.Keys)
        {
          if (endpoint.DistanceTo(line.From) < threshold && endpoint != line.From)
          {
            newStart = endpoint;
            break;
          }
        }
      }

      // Snap end point if it's unique and within threshold of another unique point
      if (uniqueEndpoints.ContainsKey(line.To))
      {
        foreach (var endpoint in uniqueEndpoints.Keys)
        {
          if (endpoint.DistanceTo(line.To) < threshold && endpoint != line.To)
          {
            newEnd = endpoint;
            break;
          }
        }
      }

      snappedLines.Add(new Line(newStart, newEnd));
    }

    return snappedLines;
  }

  private bool IsSharedEndpoint(Point3d point, List<Line> lines, double threshold)
  {
    // Count the number of lines sharing this endpoint
    int sharedCount = 0;
    foreach (var line in lines)
    {
      if (line.From.DistanceTo(point) < threshold || line.To.DistanceTo(point) < threshold)
      {
        sharedCount++;
      }
    }

    // If more than one line shares this endpoint, it is not unique
    return sharedCount > 1;
  }
  
  private List<Line> FindLargestCluster(Dictionary<Point3d, List<Line>> clusters, Point3d point, double threshold)
  {
    List<Line> largestCluster = null;
    int largestCount = 0;

    foreach (var cluster in clusters)
    {
      if (point.DistanceTo(cluster.Key) < threshold)
      {
        int count = cluster.Value.Count;
        if (count > largestCount)
        {
          largestCount = count;
          largestCluster = cluster.Value;
        }
      }
    }

    return largestCluster;
  }

  private Point3d CalculateClusterCentroid(List<Line> cluster)
  {
    var centroid = Point3d.Origin;
    foreach (var line in cluster)
    {
      centroid += line.From;
      centroid += line.To;
    }
    centroid /= cluster.Count * 2; // Each line contributes two points

    return centroid;
  }
# ---------- end c_script_2 ----------
panel_9 = Panel(c_script_2.out)  # disabled
geometry_3 = Geometry(c_script_2.Lines)  # disabled
c_script_3 = CSharpScript(lines=merge_4, tol=Slider(2, range=0..10))  # -> out, Lines; inputs lines: list of Line, tol: Double
# ---------- c_script_3: C# ----------
    // Update the class-level threshold
    var _threshold = tol;

    // Process the lines
    List<Line> snappedLines = SnapLineEndpoints(lines, _threshold);

    // Set the output parameter
    Lines = snappedLines;
# ---------- c_script_3: C# additional code ----------
  private List<Line> SnapLineEndpoints(List<Line> lines, double threshold)
  {
    // Dictionary to keep track of endpoint clusters
    var clusters = new Dictionary<Point3d, List<Line>>();

    // First, cluster the line endpoints
    foreach (var line in lines)
    {
      // Process both start and end points
      foreach (var point in new[] { line.From, line.To })
      {
        bool foundCluster = false;
        // Check if the point is within threshold of an existing cluster
        foreach (var cluster in clusters.Keys)
        {
          if (point.DistanceTo(cluster) < threshold)
          {
            clusters[cluster].Add(line);
            foundCluster = true;
            break;
          }
        }
        if (!foundCluster)
        {
          // If no cluster is found, create a new one
          clusters[point] = new List<Line> { line };
        }
      }
    }

    // Now, adjust lines to snap to the centroid of the biggest cluster they're part of
    var snappedLines = new List<Line>();
    foreach (var line in lines)
    {
      // Find the largest cluster for each endpoint
      var startCluster = FindLargestCluster(clusters, line.From, threshold);
      var endCluster = FindLargestCluster(clusters, line.To, threshold);

      // Calculate the new snapped line
      var snappedLine = new Line(
        startCluster != null ? CalculateClusterCentroid(startCluster) : line.From,
        endCluster != null ? CalculateClusterCentroid(endCluster) : line.To
        );

      snappedLines.Add(snappedLine);
    }

    return snappedLines;
  }

  private List<Line> FindLargestCluster(Dictionary<Point3d, List<Line>> clusters, Point3d point, double threshold)
  {
    List<Line> largestCluster = null;
    int largestCount = 0;

    foreach (var cluster in clusters)
    {
      if (point.DistanceTo(cluster.Key) < threshold)
      {
        int count = cluster.Value.Count;
        if (count > largestCount)
        {
          largestCount = count;
          largestCluster = cluster.Value;
        }
      }
    }

    return largestCluster;
  }

  private Point3d CalculateClusterCentroid(List<Line> cluster)
  {
    var centroid = Point3d.Origin;
    foreach (var line in cluster)
    {
      centroid += line.From;
      centroid += line.To;
    }
    centroid /= cluster.Count * 2; // Each line contributes two points

    return centroid;
  }
# ---------- end c_script_3 ----------
end_points = EndPoints(Curve=merge_4)  # -> Start, End
core_attr_data = Data(data)
core_attr_model = Data(set_material)
merge_5 = Merge(Data1=end_points.Start, Data2=end_points.End)
cull_duplicates = CullDuplicates(Points=merge_5, Tolerance=Slider(3, range=0..10), CullMode=3)  # -> Points, Indices, Valence
inject_attributes = InjectAttributes(Object=merge_4, Attributes=construct_attributes)
closest_point = ClosestPoint(Point=end_points.Start, Cloud=cull_duplicates.Points)  # -> ClosestPoint, CPIndex, Distance
closest_point_2 = ClosestPoint(Point=end_points.End, Cloud=cull_duplicates.Points)  # -> ClosestPoint, CPIndex, Distance
line_2 = Line(StartPoint=closest_point.ClosestPoint, EndPoint=closest_point_2.ClosestPoint)
gltf_2_0_display = GlTF20Display(Geometry=inject_attributes)
evaluate_length = EvaluateLength(Curve=line_2, Length=".5", Normalized=True)  # -> Point, Tangent, Parameter
deconstruct = Deconstruct(Point=evaluate_length.Point)  # -> XComponent, YComponent, ZComponent
panel_10 = Panel(deconstruct.ZComponent)
create_set = CreateSet(List=deconstruct.ZComponent)  # -> Set, Map
list_length = ListLength(List=create_set.Set)
panel_11 = Panel(c_script_3.out)
series_2 = Series(Start=0, Step=1, Count=list_length)
sort_list = SortList(Keys=create_set.Set, ValuesA=series_2)  # -> Keys, ValuesA
list_item_2 = ListItem(List=sort_list.ValuesA, Index=0, Wrap=True)  # -> Item1, Item
integer = Integer(create_set.Map)
integer_2 = Integer(list_item_2.Item1)
equality = Equality(FirstNumber=integer_2, SecondNumber=integer)  # -> Equality, Inequality

# ---- group: Assemble Drawing Attributes & Graphics
# Add Style Attribute To 2D lines
merge_6 = Merge(Data1=merge_3, Data2=horizontal_mullions, Data3=horizontal_mullions_2, Data4=grid)  # -> flatten(Result); disabled
swatch = ColourSwatch(SwatchColor=RGB(0, 0, 0))  # disabled
swatch_2 = ColourSwatch(SwatchColor=RGBA(0, 0, 0, 0))  # disabled
swatch_3 = ColourSwatch(SwatchColor=RGBA(0, 0, 0, 0))  # disabled
swatch_4 = ColourSwatch(SwatchColor=RGBA(0, 0, 0, 0))  # disabled
swatch_5 = ColourSwatch(SwatchColor=RGB(0, 0, 0))  # disabled
swatch_6 = ColourSwatch(SwatchColor=RGB(0, 0, 0))  # disabled
swatch_7 = ColourSwatch(SwatchColor=RGB(0, 0, 0))  # disabled
swatch_8 = ColourSwatch(SwatchColor=RGB(0, 0, 0))  # disabled
panel_12 = Panel("2")  # disabled
panel_13 = Panel("""10
10""")  # disabled
panel_14 = Panel("2")  # disabled
panel_15 = Panel("1")  # disabled
panel_16 = Panel("1")  # disabled
number_slider_2 = Slider(2, range=0..10)  # disabled
set_graphic = SetGraphics(Attribute=data_2, StrokeColor=swatch, StrokeWeight=panel_12, ObjectColor=swatch_5)  # disabled
set_graphic_2 = SetGraphics(Attribute=data_2, StrokeColor=swatch_8, StrokeWeight=panel_14, ObjectColor=swatch_2)  # disabled
set_graphic_3 = SetGraphics(Attribute=data_2, StrokeColor=swatch_6, StrokeWeight=panel_15, ObjectColor=swatch_3)  # disabled
set_graphic_4 = SetGraphics(Attribute=data_2, StrokeColor=swatch_7, StrokeWeight=panel_16, StrokePattern=panel_13, ObjectColor=swatch_4)  # disabled
lng_4 = ListLength(List=merge_3)  # disabled
lng_5 = ListLength(List=horizontal_mullions_2)  # disabled
lng_6 = ListLength(List=horizontal_mullions)  # disabled
lng_7 = ListLength(List=grid)  # disabled
tree_branch = TreeBranch(Tree=merge_3, Path=number_slider_2, MaintainPaths=True)  # disabled
dup_2 = DuplicateData(Data=set_graphic, Number=lng_4, Order=True)  # -> simplify(Data); disabled
dup_3 = DuplicateData(Data=set_graphic_2, Number=lng_6, Order=True)  # -> simplify(Data); disabled
dup_4 = DuplicateData(Data=set_graphic_3, Number=lng_5, Order=True)  # -> simplify(Data); disabled
dup_5 = DuplicateData(Data=set_graphic_4, Number=lng_7, Order=True)  # -> simplify(Data); disabled
merge_7 = Merge(Data1=dup_2, Data2=dup_3, Data3=dup_4, Data4=dup_5)  # -> flatten(Result); disabled
plans = Curve(merge_6)  # disabled

# ----
cull_pattern = CullPattern(List=line_2, CullPattern=equality.Inequality)
end_points_2 = EndPoints(Curve=cull_pattern)  # -> Start, End
merge_8 = Merge(Data1=end_points_2.Start, Data2=end_points_2.End)
cull_duplicates_2 = CullDuplicates(Points=merge_8, Tolerance=Slider(1, range=0..10), CullMode=3)  # -> Points, Indices, Valence

plans_2 = Curve(plans)  # disabled
core_attr_drawing = Data(merge_7)  # disabled

deconstruct_2 = Deconstruct(Point=cull_duplicates_2.Points)  # -> XComponent, YComponent, ZComponent

plans_3 = Curve(plans_2)  # disabled
attr_dwg = Data(core_attr_drawing)  # disabled

floor_2 = Geometry(program)  # disabled
attr_mdl = Data(core_attr_model)  # disabled

attr_data = Data(core_attr_data)  # disabled
integer_3 = Integer(deconstruct_2.ZComponent)
create_tree = CreateTree(Data=cull_duplicates_2.Points, Path=integer_3)
delaunay_mesh = DelaunayMesh(Points=create_tree, Plane=PlaneXY(0, 0, 0))

# ---- group: Save to Files
svg_out = ExportSVG(Geometry=plans_3, Attributes=attr_dwg, DirectoryPath=directory, FileName=svg_file_name, Save=click_to_save)  # disabled
_3dm_out = Export3DM(Geometries=floor_2, Attributes=attr_mdl, DirectoryPath=directory, FileName=_3dm_file_name, Version=7, Save=click_to_save)  # disabled
save_attr = SaveAttributes(Attributes=attr_data, DirectoryPath=directory, FileName=json_file_name, Format=0, Save=click_to_save)  # disabled

# ----
face_boundaries = FaceBoundaries(Mesh=delaunay_mesh)
explode_2 = Explode(Curve=face_boundaries, Recursive=True)  # -> flatten(Segments), Vertices
clean_duplicate_lines = CleanDuplicateLines(Lines=explode_2.Segments, Tolerance=0.01)  # -> Lines, Indices, Status

# ---- group: STRUCTURE
geometry_4 = Geometry(cull_pattern)

geometry_5 = Geometry(clean_duplicate_lines.Lines)

# ==== cluster FloorPlanMaker
floor_perimeters = ClusterInput()
mullion_spacing = ClusterInput()
mullion_depth = ClusterInput()
column_radius = ClusterInput()
facade_offset = ClusterInput()
grid_spacing = ClusterInput()
spacing = ClusterInput()
core_size = ClusterInput()
count = ClusterInput()
floor_perimeters_2 = Curve(floor_perimeters)
mullion_spacing_2 = Number(mullion_spacing)
mullion_depth_2 = Number(mullion_depth)
facade_offset_2 = Number(facade_offset)
grid_spacing_2 = Number(grid_spacing)
column_radius_2 = Number(column_radius)
spacing_2 = Number(spacing)
core_size_2 = Number(core_size)
count_2 = Number(count)
lng = ListLength(List=floor_perimeters_2)
neg = Negative(Value=mullion_depth_2)
neg_2 = Negative(Value=facade_offset_2)
vec = VectorXYZ(XComponent=spacing_2, YComponent=spacing_2, ZComponent=0)  # -> Vector, Length
division = Division(A=lng, B=count_2)
sqgrid = Square(Plane=vec.Vector, Size=spacing_2, ExtentX=count_2, ExtentY=division)  # -> Cells, flatten(Points)
short = ShortestList(ListA=floor_perimeters_2, ListB=sqgrid.Points, TrimMode=2)  # -> graft(ListA), graft(ListB)
move = Move(Geometry=short.ListA, Motion=short.ListB)  # -> Geometry, Transform
pt = Point(short.ListB)
crv = Curve(move.Geometry)
project = Project(Geometry=crv, Plane=pt)  # -> Geometry, Transform
division_2 = Division(A=core_size_2, B=2)
xy = XYPlane(Origin=pt)
crv_2 = Curve(reparameterize(project.Geometry))
neg_3 = Negative(Value=division_2)
dom = ConstructDomain(DomainStart=neg_3, DomainEnd=division_2)
explode = Explode(Curve=crv_2, Recursive=True)  # -> reparameterize(graft(Segments)), Vertices
division_3 = Division(A=mullion_depth_2, B=4)
offset = OffsetCurve(Curve=crv_2, Distance=neg, Corners=1)
rectangle = Rectangle(Plane=xy, XSize=dom, YSize=dom, Radius=0)  # -> Rectangle, Length
divlenfrom = DivideLengthFrom(Curve=explode.Segments, Length=mullion_spacing_2, Parameter="0.5")  # -> Points, Tangents, simplify(Parameters)
boundrect = BoundingRectangle(Geometry=crv_2, Plane=PlaneXY(0, 0, 0), unioned=False)
neg_4 = Negative(Value=division_3)
drec = DeconstuctRectangle(Rectangle=boundrect)  # -> BasePlane, XInterval, YInterval
hframe = HorizontalFrame(Curve=explode.Segments, Parameter=divlenfrom.Parameters)
dom_2 = ConstructDomain(DomainStart=neg_4, DomainEnd=division_3)
offset_2 = OffsetCurve(Curve=boundrect, Distance=facade_offset_2, Corners=1)
rectangle_2 = Rectangle(Plane=hframe, XSize=dom_2, YSize=mullion_depth_2, Radius=0)  # -> simplify(Rectangle), Length
cluster = Cluster(I=drec.XInterval, B=grid_spacing_2)  # -> R, y
cluster_2 = Cluster(I=drec.YInterval, B=grid_spacing_2)  # -> R, y
pshift = ShiftPaths(Data=rectangle_2.Rectangle, Offset=-1)
int = Integer(cluster.R)
int_2 = Integer(cluster_2.R)
vec_2 = VectorXYZ(XComponent=cluster.y, YComponent=cluster_2.y, ZComponent=0)  # -> simplify(Vector), Length
sqgrid_2 = Square(Plane=pt, Size=grid_spacing_2, ExtentX=int, ExtentY=int_2)  # -> Cells, simplify(Points)
move_2 = Move(Geometry=sqgrid_2.Points, Motion=vec_2.Vector)  # -> simplify(Geometry), Transform
path_mapper = PathMapper(sqgrid_2.Points, source="{A;B}(C)", target="{A;C}(B)")
pline = PolyLine(Vertices=path_mapper, Closed=False)
pline_2 = PolyLine(Vertices=sqgrid_2.Points, Closed=False)
offset_3 = OffsetCurve(Curve=crv_2, Distance=neg_2, Corners=1)  # -> simplify(Curve)
pshift_2 = ShiftPaths(Data=pline, Offset=-1)
pshift_3 = ShiftPaths(Data=pline_2, Offset=-1)
move_3 = Move(Geometry=pshift_2, Motion=vec_2.Vector)  # -> simplify(Geometry), Transform
move_4 = Move(Geometry=pshift_3, Motion=vec_2.Vector)  # -> simplify(Geometry), Transform
pshift_4 = ShiftPaths(Data=move_2.Geometry, Offset=-1)
boundary = BoundarySurfaces(Edges=offset_2)
boundary_2 = BoundarySurfaces(Edges=offset_3)
incurve = PointInCurve(Point=pshift_4, Curve=offset_3)  # -> Relationship, Point
project_2 = Project(Curve=move_4.Geometry, Brep=boundary, Direction=Vector(0, 0, 1))  # -> simplify(Curve)
project_3 = Project(Curve=move_3.Geometry, Brep=boundary, Direction=Vector(0, 0, 1))  # -> simplify(Curve)
panel = Panel("""0
-1""")
panel_2 = Panel("""0
-1""")
cull_i = CullIndex(List=move_4.Geometry, Indices=panel, Wrap=True)
cull_i_2 = CullIndex(List=move_3.Geometry, Indices=panel_2, Wrap=True)
dispatch = Dispatch(List=incurve.Point, DispatchPattern=incurve.Relationship)  # -> ListA, ListB
project_4 = Project(Curve=cull_i_2, Brep=boundary_2, Direction=Vector(0, 0, 1))
project_5 = Project(Curve=cull_i, Brep=boundary_2, Direction=Vector(0, 0, 1))
pshift_5 = ShiftPaths(Data=project_5, Offset=-1)  # -> simplify(Data)
pshift_6 = ShiftPaths(Data=project_4, Offset=-1)  # -> simplify(Data)
pshift_7 = ShiftPaths(Data=project_4, Offset=-1)  # -> simplify(Data)
pshift_8 = ShiftPaths(Data=project_5, Offset=-1)  # -> simplify(Data)
end = EndPoints(Curve=pshift_6)  # -> Start, End
end_2 = EndPoints(Curve=pshift_5)  # -> Start, End
pt_2 = Point([end_2.Start, end_2.End, dispatch.ListA, end.Start, end.End])
crv_3 = Curve([pshift_8, pshift_7, offset_3])
cir = Circle(Plane=pt_2, Radius=column_radius_2)
core = Curve(rectangle.Rectangle)
vertical_mullions = Curve(pshift)
horizontal_mullions = Curve(offset)
glazing = Curve(crv_2)
grid = Curve(crv_3)
columns = Curve(cir)
area = Area(Geometry=floor_perimeters_2)  # -> Area, Centroid
curve = EleFrontDataDescription(core, ShiftDepth=0, isNameSet=False)
curve_2 = EleFrontDataDescription(vertical_mullions, ShiftDepth=0, isNameSet=False)
curve_3 = EleFrontDataDescription(horizontal_mullions, ShiftDepth=0, isNameSet=False)
curve_4 = EleFrontDataDescription(glazing, ShiftDepth=0, isNameSet=False)
curve_5 = EleFrontDataDescription(grid, ShiftDepth=0, isNameSet=False)
curve_6 = EleFrontDataDescription(columns, ShiftDepth=0, isNameSet=False)
point = Point(graft(area.Centroid))
curve_7 = EleFrontDataDescription(core, ShiftDepth=0, isNameSet=False)
curve_8 = EleFrontDataDescription(vertical_mullions, ShiftDepth=0, isNameSet=False)
curve_9 = EleFrontDataDescription(horizontal_mullions, ShiftDepth=0, isNameSet=False)
curve_10 = EleFrontDataDescription(glazing, ShiftDepth=0, isNameSet=False)
curve_11 = EleFrontDataDescription(grid, ShiftDepth=0, isNameSet=False)
curve_12 = EleFrontDataDescription(columns, ShiftDepth=0, isNameSet=False)
area_2 = Area(Geometry=curve_10)  # -> Area, Centroid
vector_2pt = Vector2Pt(PointA=area_2.Centroid, PointB=point, Unitize=False)  # -> Vector, Length
move_5 = Move(Geometry=curve_7, Motion=vector_2pt.Vector)  # -> Geometry, Transform
move_6 = Move(Geometry=curve_8, Motion=vector_2pt.Vector)  # -> Geometry, Transform
move_7 = Move(Geometry=curve_9, Motion=vector_2pt.Vector)  # -> Geometry, Transform
move_8 = Move(Geometry=curve_10, Motion=vector_2pt.Vector)  # -> Geometry, Transform
move_9 = Move(Geometry=curve_11, Motion=vector_2pt.Vector)  # -> Geometry, Transform
move_10 = Move(Geometry=curve_12, Motion=vector_2pt.Vector)  # -> Geometry, Transform
scale = Scale(Geometry=curve_5, Center=Point(0, 0, 0), Factor="10")  # -> Geometry, Transform
scale_2 = Scale(Geometry=curve_3, Center=Point(0, 0, 0), Factor="10")  # -> Geometry, Transform
scale_3 = Scale(Geometry=curve_4, Center=Point(0, 0, 0), Factor="10")  # -> Geometry, Transform
scale_4 = Scale(Geometry=curve_2, Center=Point(0, 0, 0), Factor="10")  # -> Geometry, Transform
scale_5 = Scale(Geometry=curve, Center=Point(0, 0, 0), Factor="10")  # -> Geometry, Transform
scale_6 = Scale(Geometry=curve_6, Center=Point(0, 0, 0), Factor="10")  # -> Geometry, Transform
horizontal_mullions_2 = Curve(scale_2.Geometry)
vertical_mullions_2 = Curve(scale_4.Geometry)
columns_2 = Curve(scale_6.Geometry)
core_2 = Curve(scale_5.Geometry)
grid_2 = Curve(scale.Geometry)
glazing_2 = Curve(scale_3.Geometry)
geometry = ClusterOutput(move_5.Geometry)
geometry_2 = ClusterOutput(move_6.Geometry)
geometry_3 = ClusterOutput(move_7.Geometry)
geometry_4 = ClusterOutput(move_8.Geometry)
geometry_5 = ClusterOutput(move_9.Geometry)
geometry_6 = ClusterOutput(move_10.Geometry)

# ==== cluster Cluster
I = ClusterInput()
B = ClusterInput()
ded = DeconstructDomain(Domain=I)  # -> Start, End
subtraction = Subtraction(A=ded.End, B=ded.Start)
division = Division(A=B, B=2)
division_2 = Division(A=subtraction, B=B)
division_3 = Division(A=division_2, B=2)
round = Round(Number=division_3)  # -> Nearest, Floor, Ceiling
addition = Addition(A=round.Floor, B=1)
multiplication = Multiplication(A=addition, B=2)
addition_2 = Addition(A=multiplication, B=1)
multiplication_2 = Multiplication(A=addition_2, B=division)
neg = Negative(Value=multiplication_2)
y = ClusterOutput(neg)
R = ClusterOutput(addition_2)
