# Grasshopper definition BUILDING_v09.gh (Grasshopper 1.0.7)
# plug-ins: ShapeDiverForGrasshopper, CORE.Toolbox.Grasshopper, GrasshopperHyperGooComponents, CurvePlus

peak_radius = Slider(60, range=60..100)
base_radius = Slider(83, range=60..200)
no_floors = Slider(18, range=10..18)
floor_to_floor = Slider(12, range=8..15)
grid_spacing = Slider(40, range=35..45)
floor = BooleanToggle(True)
faces = BooleanToggle(False)
structure = BooleanToggle(True)

sddp = ShapeDiverDocumentPayload({AbsoluteTolerance=0, AngleTolerance=0, DistanceDisplayPrecision=0, GltfVersion="Gltf2", GrasshopperVersion="1.0.0007", InputGroups="{}", OutputGroups="{}", RelativeTolerance=0, RhinoVersion="7.23.22282.13001", UnitSystem=0, VersionCreated="1.13.0.0", VersionSaved="1.15.0.0"})

# ----
# Other Controls
no_sides = Slider(3, range=3..8)
count = Slider(2, range=0..10)
chamfer_high = Slider(0.9, range=0.1..0.9)
chamfer_low = Slider(0.5, range=0.1..0.9)

base_program = Panel("""Lobby
Retail
Retail
Amenity
Mechanical""")
stack_program = Panel("""Office
Office
Office
Office
Office
Office
Office
Office
Office
Mechanical""")
# Add Attributes to Models
top_program = Panel("""Mechanical
Amenity
Amenity
Mechanical""")

spacing = Slider(100, range=0..100)
count_2 = Slider(10, range=1..20)
mullion_depth = Slider(0.3, range=0..10)
mullion_spacing = Slider(1.5, range=0..10)
core_size = Slider(14, range=0..100)
column_radius = Slider(1, range=0..10)
facade_offset = Slider(0, range=0..10)

layer = Panel("Floorplates")
panel = Panel("""Floor Area
Floor Elevation
Floor No.
Program
Elevation
Area
ellipseId
Layer""")

# ----
# Parametric Tower
# STRUCTURE JSONS FOR SD
# AECTech
# New York, 2023
# Copyright: 2023 CORE studio | Thornton Tomasetti
# Contact: CORE@ThorntonTomasetti.com
# Website: https://www.aectech.us/
panel_2 = Panel("Building Massing")
panel_3 = Panel("Create Drawings")

# ---- group: Stacked Floorplate Outlines
# Floorplate Outlines
dom = ConstructDomain(DomainStart=base_radius, DomainEnd=peak_radius)
multiplication = Multiplication(A=no_sides, B=2)
subtraction = Subtraction(A=no_floors, B=1)
range = Range(Domain=dom, Steps=subtraction)
range_2 = Range(Domain=Domain(0, 1), Steps=subtraction)
multiplication_2 = Multiplication(A=subtraction, B=floor_to_floor)
polygon = Polygon(Plane=PlaneXY(0, 0, 0), Radius=range, Segments=multiplication, FilletRadius=0)  # -> Polygon, Length
multiplication_3 = Multiplication(A=multiplication_2, B=range_2)
expression = Expression(v=range_2, m=count, a=chamfer_low, b=chamfer_high, Expression="a+(Cos(v*m*pi)+1)/2.0*(b-a)")
explode = Explode(Curve=polygon.Polygon, Recursive=True)  # -> Segments, Vertices
shift = ShiftList(List=explode.Segments, Shift=1, Wrap=True)
culln = CullNth(List=explode.Segments, CullFrequency=2)
culln_2 = CullNth(List=shift, CullFrequency=2)
flip = FlipCurve(Curve=culln_2)  # -> Curve, Flag
eval = EvaluateCurve(Curve=reparameterize(culln), Parameter=graft(expression))  # -> simplify(Point), Tangent, Angle
eval_2 = EvaluateCurve(Curve=reparameterize(flip.Curve), Parameter=graft(expression))  # -> simplify(Point), Tangent, Angle
weave = Weave(Pattern=[0, 1], Stream0=eval.Point, Stream1=eval_2.Point, NullGaps=False)
pline = PolyLine(Vertices=weave, Closed=True)  # -> flatten(Polyline)
Z = UnitZ(Factor=multiplication_3)
move = Move(Geometry=pline, Motion=Z)  # -> Geometry, Transform

# ----
unit_z = UnitZ(Factor=floor_to_floor)
colour = Colour(ColourSwatch(SwatchColor=RGB(194, 194, 194)))

# ---- group: Planar Floorplate Surfaces
# Building Surfaces & Volumes
panel_4 = Panel("-1")
toggle = BooleanToggle(False)
shift_2 = ShiftList(List=move.Geometry, Shift=panel_4, Wrap=toggle)  # -> graft(List)
shift_3 = ShiftList(List=move.Geometry, Shift="1", Wrap=toggle)  # -> graft(List)
boundary = BoundarySurfaces(Edges=shift_2)  # -> flatten(Surfaces)
floorplates = Brep(boundary)
floor_perimeters = Curve(flatten(shift_2))

# ----
floors = Curve(floor_perimeters)
loft = Loft(
    Curves=[shift_2, shift_3],
    Options={Adjust=False, Closed=False, LoftEnds=0, LoftSimp=0, LoftType=0, Rebuild=10, Refit=0.01})
shift_list = ShiftList(List=flatten(loft), Shift="-1", Wrap=Toggle(False))
cap = CapHoles(Brep=loft)  # -> flatten(Brep)
deconstruct_brep = DeconstructBrep(Brep=shift_list)  # -> Faces, Edges, Vertices
flip_2 = Flip(Surface=deconstruct_brep.Faces)  # -> Surface, Result
geometry = Geometry(flatten(flip_2.Surface))
brep_edges = BrepEdges(Brep=geometry)  # -> Naked, Interior, NonManifold
list_item = ListItem(List=flatten(deconstruct_brep.Faces), Index=Slider(86, range=0..100), Wrap=True)
# Attribute Analysis
panel_5 = Panel("Analysis")
floorplates_2 = Brep(flatten(floorplates))

# ---- group: Extract Floorplate Analysis
top_program_2 = Text(top_program)
base_program_2 = Text(base_program)
stack_program_2 = Text(stack_program)
lng = ListLength(List=floorplates_2)
area = Area(Geometry=floorplates_2)  # -> Area, Centroid
lng_2 = ListLength(List=[base_program_2, top_program_2])
subtraction_2 = Subtraction(A=lng, B=lng_2)
series = Series(Start=1, Step=1, Count=lng)
pdecon = Deconstruct(Point=area.Centroid)  # -> XComponent, YComponent, ZComponent
repeat = RepeatData(Data=stack_program_2, Length=subtraction_2)
merge = Merge(Data1=flatten(base_program_2), Data2=flatten(repeat), Data3=flatten(top_program_2))

# ---- group: Floorplates
program = Brep(cap)

# ----
floor_2 = Geometry(program)

# ---- group: Floor Attributes
elevation = Number(pdecon.ZComponent)
floor_number = Number(series)
program_2 = Text(merge)

# ---- group: Floor Attributes / area
floor_area = Number(area.Area)

# ----
floor_area_2 = Number(floor_area)
elevation_2 = Number(elevation)
floor_number_2 = Number(floor_number)
program_3 = Text(program_2)

param_viewer = ParamViewer(floor_number)
unit_z_2 = UnitZ(Factor=1)
colour_swatch = ColourSwatch(SwatchColor=RGB(173, 54, 207))
colour_swatch_2 = ColourSwatch(SwatchColor=RGB(71, 71, 204))
gltf_2_0_material = GlTF20Material(
    BaseColorFactor=ColourSwatch(SwatchColor=RGB(184, 224, 224)),
    MetallicFactor=0,
    RoughnessFactor=1,
    EmissiveFactor=RGB(0, 0, 0),
    AlphaMode="OPAQUE",
    AlphaCutoff=0.5,
    DoubleSided=True)
panel_6 = Panel("(")

# ---- group: FACES
geometry_2 = Geometry(geometry)

# ----
gltf_2_0_material_2 = GlTF20Material(
    BaseColorFactor=colour_swatch,
    MetallicFactor=0,
    RoughnessFactor=1,
    EmissiveFactor=RGB(0, 0, 0),
    AlphaMode="OPAQUE",
    AlphaCutoff=0.5,
    DoubleSided=True)
panel_7 = Panel(",")
gltf_2_0_material_3 = GlTF20Material(
    BaseColorFactor=colour_swatch_2,
    MetallicFactor=0,
    RoughnessFactor=1,
    EmissiveFactor=RGB(0, 0, 0),
    AlphaMode="OPAQUE",
    AlphaCutoff=0.5,
    DoubleSided=True)
panel_8 = Panel(")")
panel_9 = Panel("""Material
Name""")
panel_10 = Panel("""Material
Name""")
# sort edges into columns and beams
panel_11 = Panel("FLOOR")
merge_2 = Merge(Data1=gltf_2_0_material, Data2="STRUCTURE")
merge_3 = Merge(Data1=gltf_2_0_material_2, Data2="STRUCTURE")
panel_12 = Panel("""Material
Name""")
construct_attributes = ConstructAttributes(Keys=panel_9, Values=merge_2)
merge_4 = Merge(Data1=gltf_2_0_material_3, Data2=panel_11)
construct_attributes_2 = ConstructAttributes(Keys=panel_10, Values=merge_3)
construct_attributes_3 = ConstructAttributes(Keys=panel_12, Values=merge_4)
inject_attributes = InjectAttributes(Object=geometry_2, Attributes=construct_attributes)
filter = StreamFilter(Gate=faces, Stream1=inject_attributes)
panel_13 = Panel("FLOOR (ELEV & AREA)")
encoding = ValueList({"ASCII", "UTF_8", "UTF_8_NO_BOM"}, selected="ASCII")
encoding_2 = ValueList({"ASCII", "UTF_8", "UTF_8_NO_BOM"}, selected="ASCII")
encoding_3 = ValueList({"ASCII", "UTF_8", "UTF_8_NO_BOM"}, selected="ASCII")
panel_14 = Panel("NODES")
panel_15 = Panel("BEAMS")
panel_16 = Panel("COLMS")
panel_17 = Panel("PLATE REAGION")
end_of_line = ValueList({"CRLF", "LF", "CR"}, selected="CRLF")
end_of_line_2 = ValueList({"CRLF", "LF", "CR"}, selected="CRLF")
extension = ValueList({"txt", "g", "gcode", "csv", "xml", "json", "ifc"}, selected="json")
extension_2 = ValueList({"txt", "g", "gcode", "csv", "xml", "json", "ifc"}, selected="json")
end_of_line_3 = ValueList({"CRLF", "LF", "CR"}, selected="CRLF")
extension_3 = ValueList({"txt", "g", "gcode", "csv", "xml", "json", "ifc"}, selected="json")
text_export_options = TextExportOptions(Extension=extension_3, EndOfLine=end_of_line_3, Encoding=encoding_3, N=False)
text_export_options_2 = TextExportOptions(Extension=extension, EndOfLine=end_of_line, Encoding=encoding, N=False)
text_export_options_3 = TextExportOptions(Extension=extension_2, EndOfLine=end_of_line_2, Encoding=encoding_2, N=False)

# ---- group: Add Attributes to Model
# Build Attributes Per Floor
lng_3 = ListLength(List=floor_2)
guids = CreateGuids(Count=lng_3)
concat = Concatenate(FragmentA="e-", FragmentB=guids)  # -> simplify(graft(Result))
panel_18 = Panel("0.95")
panel_19 = Panel("1.0")
panel_20 = Panel("0.1")
preview = CustomPreview(Geometry=floor_2, Material=colour)

# ----
dup = DuplicateData(Data=layer, Number=lng_3, Order=True)

# ---- group: Add Attributes to Model (continued)
merge_5 = Merge(
    Data1=simplify(graft(floor_area_2)),
    Data2=simplify(graft(elevation_2)),
    Data3=simplify(graft(floor_number_2)),
    Data4=simplify(graft(program_3)),
    Data5=simplify(graft(elevation_2)),
    Data6=simplify(graft(floor_area_2)),
    Data7=simplify(graft(concat)),
    Data8=simplify(graft(dup)))
attributes = ConstructAttributes(Name=concat, Layer=layer, Groups=concat, Keys=panel, Values=merge_5)  # -> simplify(Attribute)
data = Data(flatten(attributes))

# ---- group: Generate Drawings
floor_plan_maker = FloorPlanMaker(
    floor_perimeters=floors,
    spacing=Slider(200, range=0..1000),
    count=count_2,
    mullion_depth=mullion_depth,
    mullion_spacing=mullion_spacing,
    core_size=core_size,
    grid_spacing=grid_spacing,
    facade_offset=facade_offset,
    column_radius=column_radius)  # -> geometry, geometry_2, geometry_3, geometry_4, geometry_5, geometry_6
merge_6 = Merge(Data1=simplify(floor_plan_maker.geometry), Data3=simplify(floor_plan_maker.geometry_6))  # -> simplify(Result)
horizontal_mullions = Curve(simplify(floor_plan_maker.geometry_3))
horizontal_mullions_2 = Curve(simplify(floor_plan_maker.geometry_4))
grid = Curve(simplify(floor_plan_maker.geometry_5))
data_2 = Data(attributes)

# ----
panel_21 = Panel(merge_5)
area_2 = Area(Geometry=floor_plan_maker.geometry_6)  # -> Area, Centroid

# ----
# Split At Intersections
panel_22 = Panel("25")
c_script = CSharpScript(Curves=grid, dTol=panel_22)  # -> out, Split; inputs Curves: tree of Curve, dTol: Double
# ---------- c_script: C# ----------
    var lines = ProcessCurves(Curves, dTol);
    Split = lines;
# ---------- c_script: C# additional code ----------
  public static DataTree<Line> ProcessCurves(DataTree<Curve> curvesTree, double dTol)
  {
    List<Curve> allCurves = new List<Curve>();
    Dictionary<Curve, GH_Path> curveToPathMap = new Dictionary<Curve, GH_Path>();

    foreach (GH_Path path in curvesTree.Paths)
    {
      List<Curve> branchCurves = curvesTree.Branch(path);
      allCurves.AddRange(branchCurves);
      foreach (var curve in branchCurves)
      {
        curveToPathMap[curve] = path;
      }
    }

    // Convert curves to polylines based on the dTol
    List<Polyline> polylines = new List<Polyline>();
    foreach (var curve in allCurves)
    {
      Polyline polyline;
      if (curve.TryGetPolyline(out polyline))
      {
        polylines.Add(polyline);
      }
      else
      {
        var parameters = curve.DivideByLength(dTol, true);
        if (parameters != null)
        {
          curve.ToPolyline(0, 0, 0, dTol).TryGetPolyline(out polyline);
          polylines.Add(polyline);
        }
      }
    }

    // Split curves at intersections
    List<Curve> splittedCurves = new List<Curve>();
    for (int i = 0; i < polylines.Count; i++)
    {
      Curve curveToSplit = polylines[i].ToNurbsCurve();
      List<double> splitParameters = new List<double>();

      for (int j = 0; j < polylines.Count; j++)
      {
        if (i != j)
        {
          var intersections = Rhino.Geometry.Intersect.Intersection.CurveCurve(curveToSplit, polylines[j].ToNurbsCurve(), 0.01, 0.01);
          foreach (var intersection in intersections)
          {
            if (intersection.IsOverlap)
            {
              var overlapSegment = intersection.OverlapA;
              splitParameters.Add(overlapSegment.T0);
              splitParameters.Add(overlapSegment.T1);
            }
            else
            {
              splitParameters.Add(intersection.ParameterA);
            }
          }
        }
      }

      splittedCurves.AddRange(curveToSplit.Split(splitParameters));
    }

    // Convert the resulting split curves into lines
    List<Line> resultLines = new List<Line>();
    foreach (var curve in splittedCurves)
    {
      Polyline polyline;
      if (curve.TryGetPolyline(out polyline))
      {
        for (int i = 0; i < polyline.SegmentCount; i++)
        {
          resultLines.Add(polyline.SegmentAt(i));
        }
      }
    }

    DataTree<Line> resultLinesTree = new DataTree<Line>();
    foreach (var line in resultLines)
    {
      Curve closestCurve = null;
      double closestDist = double.MaxValue;

      foreach (var curve in allCurves)
      {
        var point = 0.5 * line.From + 0.5 * line.To;
        double t;
        curve.ClosestPoint(point, out t);
        var cp = curve.PointAt(t);
        var dist = cp.DistanceTo(point);
        if (dist < closestDist)
        {
          closestDist = dist;
          closestCurve = curve;
        }
      }

      if (closestCurve != null)
      {
        var path = curveToPathMap[closestCurve];
        resultLinesTree.Add(line, path);
      }
    }

    return resultLinesTree;
  }
# ---------- end c_script ----------
curve = Curve(c_script.Split)

move_2 = Move(Geometry=area_2.Centroid, Motion=unit_z)  # -> Geometry, Transform
line = Line(StartPoint=area_2.Centroid, EndPoint=move_2.Geometry)

merge_7 = Merge(Data1=brep_edges.Naked, Data2=curve, Data3=line)  # -> flatten(Result)
merge_8 = Merge(Data1=curve, Data2=line)  # -> flatten(Result)

end_points = EndPoints(Curve=merge_8)  # -> Start, End
core_attr_data = Data(data)
merge_9 = Merge(Data1=end_points.Start, Data2=end_points.End)
cull_duplicates = CullDuplicates(Points=merge_9, Tolerance=Slider(4, range=0..10), CullMode=3)  # -> Points, Indices, Valence
closest_point = ClosestPoint(Point=end_points.Start, Cloud=cull_duplicates.Points)  # -> ClosestPoint, CPIndex, Distance
closest_point_2 = ClosestPoint(Point=end_points.End, Cloud=cull_duplicates.Points)  # -> ClosestPoint, CPIndex, Distance
line_2 = Line(StartPoint=closest_point.ClosestPoint, EndPoint=closest_point_2.ClosestPoint)
evaluate_length = EvaluateLength(Curve=line_2, Length=".5", Normalized=True)  # -> Point, Tangent, Parameter
deconstruct = Deconstruct(Point=evaluate_length.Point)  # -> XComponent, YComponent, ZComponent
panel_23 = Panel(deconstruct.ZComponent)
create_set = CreateSet(List=deconstruct.ZComponent)  # -> Set, Map
list_length = ListLength(List=create_set.Set)
series_2 = Series(Start=0, Step=1, Count=list_length)
sort_list = SortList(Keys=create_set.Set, ValuesValuesA=series_2)  # -> Keys, ValuesValuesA
list_item_2 = ListItem(List=sort_list.ValuesValuesA, Index=0, Wrap=True)  # -> Item1, Item
integer = Integer(create_set.Map)
integer_2 = Integer(list_item_2.Item1)
equality = Equality(FirstNumber=integer_2, SecondNumber=integer)  # -> Equality, Inequality
cull_pattern = CullPattern(List=line_2, CullPattern=equality.Inequality)
end_points_2 = EndPoints(Curve=cull_pattern)  # -> Start, End
merge_10 = Merge(Data1=end_points_2.Start, Data2=end_points_2.End)
cull_duplicates_2 = CullDuplicates(Points=merge_10, Tolerance=Slider(1, range=0..10), CullMode=3)  # -> Points, Indices, Valence
c_script_2 = CSharpScript(lines=cull_pattern, tol=Slider(1, range=0..10))  # -> out, Lines; inputs lines: list of Line, tol: Double
# ---------- c_script_2: C# ----------
    double tolerance = tol;

    // Create a list to store lines that meet the condition
    List<Line> filteredLines = RemoveLinesWithUniqueEndpoints(lines, tolerance);

    // Assign the filtered list to the output parameter
    Lines = filteredLines;
# ---------- c_script_2: C# additional code ----------
  private List<Line> RemoveLinesWithUniqueEndpoints(List<Line> lines, double tolerance)
  {
    // This dictionary will map each endpoint to a list of lines that use it.
    var endpointMap = new Dictionary<Point3d, List<Line>>(new Point3dEqualityComparer(tolerance));

    // Populate the dictionary with endpoints and their associated lines
    foreach (var line in lines)
    {
      AddLineToEndpointMap(endpointMap, line.From, line, tolerance);
      AddLineToEndpointMap(endpointMap, line.To, line, tolerance);
    }

    // Filter out lines where at least one endpoint is not shared
    List<Line> filteredLines = new List<Line>();
    foreach (var line in lines)
    {
      if (endpointMap[line.From].Count > 1 && endpointMap[line.To].Count > 1)
      {
        filteredLines.Add(line);
      }
    }

    return filteredLines;
  }

  // Helper method to add lines to the endpoint map, considering tolerance
  private void AddLineToEndpointMap(Dictionary<Point3d, List<Line>> map, Point3d endpoint, Line line, double tol)
  {
    bool found = false;
    foreach (var point in map.Keys)
    {
      if (endpoint.DistanceTo(point) <= tol)
      {
        map[point].Add(line);
        found = true;
        break;
      }
    }
    if (!found)
    {
      map[endpoint] = new List<Line> { line };
    }
  }

  // Equality comparer to handle tolerance when comparing points
  private class Point3dEqualityComparer : IEqualityComparer<Point3d>
  {
    private readonly double _tolerance;

    public Point3dEqualityComparer(double tolerance)
    {
      _tolerance = tolerance;
    }

    public bool Equals(Point3d x, Point3d y)
    {
      return x.DistanceTo(y) <= _tolerance;
    }

    public int GetHashCode(Point3d obj)
    {
      // This is a simple hashing method that could be improved for performance and accuracy
      return obj.GetHashCode();
    }
  }
# ---------- end c_script_2 ----------
vector = Vector(c_script_2.Lines)
dot_product = DotProduct(VectorA=vector, VectorB=unit_z_2, Unitize=invert(False))
absolute = Absolute(Value=dot_product)
round = Round(Number=absolute)  # -> Nearest, Floor, Ceiling
ghpython_script = GhPythonScript(lines=c_script_2.Lines)  # -> out, edges, nodes, graph_json; inputs lines: list of Line
# ---------- ghpython_script: Python ----------
__author__ = "NAzel"
__version__ = "2023.11.04"

import rhinoscriptsyntax as rs
import rhinoscriptsyntax as rs
import Rhino.Geometry as rg
import json
from System import Guid

def create_graph_from_lines(lines):
    nodes = []
    edges = []
    node_index = {}
    json_graph = {"nodes": [], "edges": []}

    # Extract nodes and assign unique IDs
    for line in lines:
        #for start and end of this line
        for pt in [line.From, line.To]:
            #create A Key for that point
            pt_key = (pt.X, pt.Y, pt.Z)
            #if that point is not in our Node Dict. 
            if pt_key not in node_index:
                
                #{(x,y,z)key:index
                #index is the current size of nodes
                node_index[pt_key] = len(nodes)
                #Add it to Nodes
                
                #nodes[node_index[pt_key]] = pt
                nodes.append(pt)
                json_graph["nodes"].append({"x": pt.X, "y": pt.Y, "z": pt.Z})
    
    # Create edges with node IDs
    for line in lines:
        start_id = node_index[(line.From.X, line.From.Y, line.From.Z)]
        end_id = node_index[(line.To.X, line.To.Y, line.To.Z)]
        edges.append((start_id, end_id))
        json_graph["edges"].append([start_id, end_id])

    return nodes, edges, json.dumps(json_graph)

# Call the function and assign the outputs
nodes, edges, graph_json = create_graph_from_lines(lines)

# Now nodes, edges, and graph_json can be used as outputs in your Grasshopper component.
# ---------- end ghpython_script ----------
point = Point(ghpython_script.nodes)
deconstruct_2 = Deconstruct(Point=point)  # -> XComponent, YComponent, ZComponent
integer_3 = Integer(deconstruct_2.ZComponent)
ghpython_script_2 = GhPythonScript(data=point, path=integer_3)  # -> out, tree; inputs data: list of Point3d, path: list of Int32
# ---------- ghpython_script_2: Python ----------
__author__ = "NAzel"
__version__ = "2023.11.04"

import rhinoscriptsyntax as rs

import Rhino.Geometry as rg
import Grasshopper as gh

def data_to_branches(data_list, int_list):
    # Create an empty Grasshopper DataTree (to store the output data)
    data_tree = gh.DataTree[object]()
    
    # Loop over the paired data and integer lists
    for i, data in enumerate(data_list):
        # Create a Grasshopper path using the corresponding integer
        # This assumes int_list is aligned with data_list
        branch_path = gh.Kernel.Data.GH_Path(int_list[i])
        # Add the data item to the corresponding branch in the data tree
        data_tree.Add(data, branch_path)
        
    return data_tree

# These should be replaced with the actual inputs from the Grasshopper component
data_list = data # The list of data items
int_list = path # The list of integers representing branch indices

# Call the function with the inputs
tree = data_to_branches(data_list, int_list)
# ---------- end ghpython_script_2 ----------
delaunay_mesh = DelaunayMesh(Points=ghpython_script_2.tree, Plane=PlaneXY(0, 0, 0))
face_boundaries = FaceBoundaries(Mesh=delaunay_mesh)
discontinuity = Discontinuity(Curve=face_boundaries, Level=1)  # -> Points, Parameters
face_boundaries_2 = FaceBoundaries(Mesh=delaunay_mesh)
convex_hull = ConvexHull(Points=ghpython_script_2.tree, Plane=PlaneXY(0, 0, 0))  # -> Hull, HullZ, Indices
mesh_edges = MeshEdges(Mesh=delaunay_mesh)  # -> NakedEdges, InteriorEdges, NonManifoldEdges
bounding_rectangle = BoundingRectangle(Geometry=delaunay_mesh, Plane=PlaneXY(0, 0, 0), unioned=False)
join_curves = JoinCurves(Curves=mesh_edges.NakedEdges, Preserve=False)
geometry_3 = Geometry(flatten(join_curves))
point_2 = Point(ghpython_script.nodes)
dispatch = Dispatch(List=ghpython_script.edges, DispatchPattern=round.Nearest)  # -> ListA, ListB
area_3 = Area(Geometry=flatten(geometry_3))  # -> Area, Centroid
# Use Nodes to make Mesh Faces that preserve node ID.
deconstruct_3 = Deconstruct(Point=point_2)  # -> XComponent, YComponent, ZComponent

# ---- group: STRUCTURE
geometry_4 = Geometry(c_script_2.Lines)

# ----
deconstruct_4 = Deconstruct(Point=area_3.Centroid)  # -> XComponent, YComponent, ZComponent
unit_z_3 = UnitZ(Factor=deconstruct_4.ZComponent)

# ---- group: beams
data_3 = Data(dispatch.ListB)

# ---- group: columns
data_4 = Data(dispatch.ListA)

# ----
ghpython_script_3 = GhPythonScript(x=deconstruct_3.XComponent, y=deconstruct_3.YComponent, z=deconstruct_3.ZComponent)  # -> out, flatten(a)
# ---------- ghpython_script_3: Python ----------
__author__ = "NAzel"
__version__ = "2023.11.04"

import rhinoscriptsyntax as rs
a = (x, y, z)
# ---------- end ghpython_script_3 ----------
custom_preview = CustomPreview(Geometry=geometry_4, Material=colour_swatch)
move_3 = Move(Geometry=flatten(convex_hull.Hull), Motion=unit_z_3)  # -> Geometry, Transform
explode_2 = Explode(Curve=move_3.Geometry, Recursive=True)  # -> flatten(Segments), Vertices
clean_duplicate_lines = CleanDuplicateLines(Lines=explode_2.Segments, Tolerance=0.01)  # -> Lines, Indices, Status
control_points = ControlPoints(Curve=move_3.Geometry)  # -> Points, Weights, Knots

# ---- group: FLOOR
geometry_5 = Geometry(clean_duplicate_lines.Lines)

# ----
custom_preview_2 = CustomPreview(Geometry=geometry_5, Material=colour_swatch_2)
closest_point_3 = ClosestPoint(Point=control_points.Points, Cloud=ghpython_script.nodes)  # -> ClosestPoint, CPIndex, Distance
ghpython_script_4 = GhPythonScript(x=closest_point_3.CPIndex)  # -> out, flatten(a); inputs x: list of Int32
# ---------- ghpython_script_4: Python ----------
__author__ = "NAzel"
__version__ = "2023.11.04"

import rhinoscriptsyntax as rs
b = []
for i in x:
    
    b.append(i)
    
a = str(b)
# ---------- end ghpython_script_4 ----------
sort_list_2 = SortList(Keys=deconstruct_4.ZComponent, ValuesValuesA=geometry_3, ValuesA=area_3.Area)  # -> Keys, ValuesValuesA, ValuesA
list_item_3 = ListItem(List=closest_point_3.CPIndex, Index=0, Wrap=True)  # -> Item, Item1, Item2
ghpython_script_5 = GhPythonScript(x=list_item_3.Item, y=list_item_3.Item1, z=list_item_3.Item2)  # -> out, simplify(a); same code as ghpython_script_3
control_points_2 = ControlPoints(Curve=sort_list_2.ValuesValuesA)  # -> Points, Weights, Knots
discontinuity_2 = Discontinuity(Curve=sort_list_2.ValuesValuesA, Level=1)  # -> Points, Parameters
ghpython_script_6 = GhPythonScript(node=ghpython_script_3.a, col=data_4, beam=data_3, floor=ghpython_script_5.a)  # -> out, json_out; inputs node: list, col: list, beam: list, floor: tree
# ---------- ghpython_script_6: Python ----------
__author__ = "NAzel"
__version__ = "2023.11.04"


import rhinoscriptsyntax as rs
import rhinoscriptsyntax as rs
import Rhino.Geometry as rg
import json
from System import Guid


nodes = []
for n in node:
    nodes.append(float(n))
    
floors = []
for path in floor.Paths:
    this_floor = []
    for item in floor.Branch(path):
        this_floor.append(int(item))
    floors.append(this_floor)
    
my_json = {"nodes":nodes, "columns":col, "beams":beam, "floors":floors}
jo = json.dumps(my_json, indent=4)

json_out = jo
print(json_out)
# ---------- end ghpython_script_6 ----------
ghpython_script_7 = GhPythonScript(x=sort_list_2.Keys, y=sort_list_2.ValuesA)  # -> out, a; inputs x: list, y: list
# ---------- ghpython_script_7: Python ----------
__author__ = "NAzel"
__version__ = "2023.11.04"

import rhinoscriptsyntax as rs
import json

out = []

for i in range(len(x)):
    out.append({'floor':int(i), 'elev':round(x[i],5), 'area':round(float(y[i]),5)})

print out
a = json.dumps(out, indent=4)
# ---------- end ghpython_script_7 ----------
panel_24 = Panel(ghpython_script_4.a)
inject_attributes_2 = InjectAttributes(Object=geometry_4, Attributes=construct_attributes_2)
inject_attributes_3 = InjectAttributes(Object=geometry_5, Attributes=construct_attributes_3)

# ---- group: FLOORS FOR WIND LOAD
ghpython_script_8 = GhPythonScript(points=simplify(control_points_2.Points))  # -> out, json; inputs points: tree of Point3d
# ---------- ghpython_script_8: Python ----------
__author__ = "NAzel"
__version__ = "2023.11.04"

import rhinoscriptsyntax as rs
import Rhino.Geometry as rg
import json
import ghpythonlib.treehelpers as th
import Rhino.Geometry as rg
import json
import ghpythonlib.treehelpers as th



def tree_to_json(point_tree):
    # Initialize a list to hold dictionaries of paths and points
    json_objects = []

    # Iterate over all the paths in the tree
    for path in point_tree.Paths:
        # Create a dictionary for each path
        path_dict = {"name": str(path), "points": []}
        # Iterate over all the points in the current path
        for point in point_tree.Branch(path):
            # Append a dictionary of the point coordinates to the 'points' key
            point_dict = {"x": point.X, "y": point.Y, "z": point.Z}
            path_dict["points"].append(point_dict)
        # Append the path dictionary to the list of objects
        json_objects.append(path_dict)

    # Convert the list of dictionaries to a JSON string
    return json.dumps(json_objects, indent=4)


# Convert the tree to a list of lists (one per branch)
json = tree_to_json(points)  # Convert the tree to JSON

# Output the JSON string
print(json)
# ---------- end ghpython_script_8 ----------

# ----
filter_2 = StreamFilter(Gate=floor, Stream1=inject_attributes_3)
filter_3 = StreamFilter(Gate=structure, Stream1=inject_attributes_2)
merge_11 = Merge(Data1=filter, Data2=filter_3, Data3=filter_2)

building_floor_edge = DownloadExport(Data=ghpython_script_7.a, Options=text_export_options_2, Name="BUILDING_FLOOR_ELV_AREA")
building_structure = DownloadExport(Data=ghpython_script_6.json_out, Options=text_export_options, Name="BUILDING_STRUCTURE")
building_floor_edge_2 = DownloadExport(Data=ghpython_script_8.json, Options=text_export_options_3, Name="BUILDING_FLOOR_EDGE")
gltf_2_0_display = GlTF20Display(Geometry=merge_11)

# ==== cluster FloorPlanMaker
floor_perimeters = ClusterInput()
mullion_spacing = ClusterInput()
mullion_depth = ClusterInput()
column_radius = ClusterInput()
facade_offset = ClusterInput()
grid_spacing = ClusterInput()
spacing = ClusterInput()
core_size = ClusterInput()
count = ClusterInput()
floor_perimeters_2 = Curve(floor_perimeters)
mullion_spacing_2 = Number(mullion_spacing)
mullion_depth_2 = Number(mullion_depth)
facade_offset_2 = Number(facade_offset)
grid_spacing_2 = Number(grid_spacing)
column_radius_2 = Number(column_radius)
spacing_2 = Number(spacing)
core_size_2 = Number(core_size)
count_2 = Number(count)
lng = ListLength(List=floor_perimeters_2)
neg = Negative(Value=mullion_depth_2)
neg_2 = Negative(Value=facade_offset_2)
vec = VectorXYZ(XComponent=spacing_2, YComponent=spacing_2, ZComponent=0)  # -> Vector, Length
division = Division(A=lng, B=count_2)
sqgrid = Square(Plane=vec.Vector, Size=spacing_2, ExtentX=count_2, ExtentY=division)  # -> Cells, flatten(Points)
short = ShortestList(ListA=floor_perimeters_2, ListB=sqgrid.Points, TrimMode=2)  # -> graft(ListA), graft(ListB)
move = Move(Geometry=short.ListA, Motion=short.ListB)  # -> Geometry, Transform
pt = Point(short.ListB)
crv = Curve(move.Geometry)
project = Project(Geometry=crv, Plane=pt)  # -> Geometry, Transform
division_2 = Division(A=core_size_2, B=2)
xy = XYPlane(Origin=pt)
crv_2 = Curve(reparameterize(project.Geometry))
neg_3 = Negative(Value=division_2)
dom = ConstructDomain(DomainStart=neg_3, DomainEnd=division_2)
explode = Explode(Curve=crv_2, Recursive=True)  # -> reparameterize(graft(Segments)), Vertices
panel = Panel("0.5")
division_3 = Division(A=mullion_depth_2, B=4)
offset = OffsetCurve(Curve=crv_2, Distance=neg, Corners=1)
rectangle = Rectangle(Plane=xy, XSize=dom, YSize=dom, Radius=0)  # -> Rectangle, Length
boundrect = BoundingRectangle(Geometry=crv_2, Plane=PlaneXY(0, 0, 0), unioned=False)
neg_4 = Negative(Value=division_3)
drec = DeconstuctRectangle(Rectangle=boundrect)  # -> BasePlane, XInterval, YInterval
dom_2 = ConstructDomain(DomainStart=neg_4, DomainEnd=division_3)
offset_2 = OffsetCurve(Curve=boundrect, Distance=facade_offset_2, Corners=1)
cluster = Cluster(I=drec.XInterval, B=grid_spacing_2)  # -> R, y
cluster_2 = Cluster(I=drec.YInterval, B=grid_spacing_2)  # -> R, y
int = Integer(cluster.R)
int_2 = Integer(cluster_2.R)
vec_2 = VectorXYZ(XComponent=cluster.y, YComponent=cluster_2.y, ZComponent=0)  # -> simplify(Vector), Length
sqgrid_2 = Square(Plane=pt, Size=grid_spacing_2, ExtentX=int, ExtentY=int_2)  # -> Cells, simplify(Points)
move_2 = Move(Geometry=sqgrid_2.Points, Motion=vec_2.Vector)  # -> simplify(Geometry), Transform
path_mapper = PathMapper(sqgrid_2.Points, source="{A;B}(C)", target="{A;C}(B)")
pline = PolyLine(Vertices=path_mapper, Closed=False)
pline_2 = PolyLine(Vertices=sqgrid_2.Points, Closed=False)
offset_3 = OffsetCurve(Curve=crv_2, Distance=neg_2, Corners=1)  # -> simplify(Curve)
pshift = ShiftPaths(Data=pline, Offset=-1)
pshift_2 = ShiftPaths(Data=pline_2, Offset=-1)
move_3 = Move(Geometry=pshift, Motion=vec_2.Vector)  # -> simplify(Geometry), Transform
move_4 = Move(Geometry=pshift_2, Motion=vec_2.Vector)  # -> simplify(Geometry), Transform
pshift_3 = ShiftPaths(Data=move_2.Geometry, Offset=-1)
boundary = BoundarySurfaces(Edges=offset_2)
boundary_2 = BoundarySurfaces(Edges=offset_3)
incurve = PointInCurve(Point=pshift_3, Curve=offset_3)  # -> Relationship, Point
project_2 = Project(Curve=move_4.Geometry, Brep=boundary, Direction=Vector(0, 0, 1))  # -> simplify(Curve)
project_3 = Project(Curve=move_3.Geometry, Brep=boundary, Direction=Vector(0, 0, 1))  # -> simplify(Curve)
panel_2 = Panel("""0
-1""")
panel_3 = Panel("""0
-1""")
cull_i = CullIndex(List=move_4.Geometry, Indices=panel_2, Wrap=True)
cull_i_2 = CullIndex(List=move_3.Geometry, Indices=panel_3, Wrap=True)
dispatch = Dispatch(List=incurve.Point, DispatchPattern=incurve.Relationship)  # -> ListA, ListB
project_4 = Project(Curve=cull_i_2, Brep=boundary_2, Direction=Vector(0, 0, 1))
project_5 = Project(Curve=cull_i, Brep=boundary_2, Direction=Vector(0, 0, 1))
pshift_4 = ShiftPaths(Data=project_5, Offset=-1)  # -> simplify(Data)
pshift_5 = ShiftPaths(Data=project_4, Offset=-1)  # -> simplify(Data)
pshift_6 = ShiftPaths(Data=project_5, Offset=-1)  # -> simplify(Data)
pshift_7 = ShiftPaths(Data=project_4, Offset=-1)  # -> simplify(Data)
end = EndPoints(Curve=pshift_5)  # -> Start, End
end_2 = EndPoints(Curve=pshift_4)  # -> Start, End
pt_2 = Point([end_2.Start, end_2.End, dispatch.ListA, end.Start, end.End])

crv_3 = Curve([pshift_6, pshift_7])
crv_4 = Curve([pshift_6, pshift_7, offset_3])

cir = Circle(Plane=pt_2, Radius=column_radius_2)
core = Curve(rectangle.Rectangle)
horizontal_mullions = Curve(offset)
grid = Curve(crv_3)
columns = Curve(cir)
glazing = Curve(crv_2)
area = Area(Geometry=floor_perimeters_2)  # -> Area, Centroid
point = Point(graft(area.Centroid))
area_2 = Area(Geometry=glazing)  # -> Area, Centroid
vector_2pt = Vector2Pt(PointA=area_2.Centroid, PointB=point, Unitize=False)  # -> Vector, Length
move_5 = Move(Geometry=core, Motion=vector_2pt.Vector)  # -> Geometry, Transform
move_6 = Move(Motion=vector_2pt.Vector)  # -> Geometry, Transform
move_7 = Move(Geometry=horizontal_mullions, Motion=vector_2pt.Vector)  # -> Geometry, Transform
move_8 = Move(Motion=vector_2pt.Vector)  # -> Geometry, Transform
move_9 = Move(Geometry=grid, Motion=vector_2pt.Vector)  # -> Geometry, Transform
move_10 = Move(Geometry=columns, Motion=vector_2pt.Vector)  # -> Geometry, Transform
scale = Scale(Geometry=grid, Center=Point(0, 0, 0), Factor="10")  # -> Geometry, Transform
scale_2 = Scale(Geometry=horizontal_mullions, Center=Point(0, 0, 0), Factor="10")  # -> Geometry, Transform
scale_3 = Scale(Geometry=glazing, Center=Point(0, 0, 0), Factor="10")  # -> Geometry, Transform
scale_4 = Scale(Center=Point(0, 0, 0), Factor="10")  # -> Geometry, Transform
scale_5 = Scale(Geometry=core, Center=Point(0, 0, 0), Factor="10")  # -> Geometry, Transform
scale_6 = Scale(Geometry=columns, Center=Point(0, 0, 0), Factor="10")  # -> Geometry, Transform
horizontal_mullions_2 = Curve(scale_2.Geometry)
vertical_mullions = Curve(scale_4.Geometry)
columns_2 = Curve(scale_6.Geometry)
core_2 = Curve(scale_5.Geometry)
grid_2 = Curve(scale.Geometry)
glazing_2 = Curve(scale_3.Geometry)
geometry = ClusterOutput(move_5.Geometry)
geometry_2 = ClusterOutput(move_6.Geometry)
geometry_3 = ClusterOutput(move_7.Geometry)
geometry_4 = ClusterOutput(move_8.Geometry)
geometry_5 = ClusterOutput(move_9.Geometry)
geometry_6 = ClusterOutput(move_10.Geometry)

# ==== cluster Cluster
I = ClusterInput()
B = ClusterInput()
ded = DeconstructDomain(Domain=I)  # -> Start, End
subtraction = Subtraction(A=ded.End, B=ded.Start)
division = Division(A=B, B=2)
division_2 = Division(A=subtraction, B=B)
division_3 = Division(A=division_2, B=2)
round = Round(Number=division_3)  # -> Nearest, Floor, Ceiling
addition = Addition(A=round.Floor, B=1)
multiplication = Multiplication(A=addition, B=2)
addition_2 = Addition(A=multiplication, B=1)
multiplication_2 = Multiplication(A=addition_2, B=division)
neg = Negative(Value=multiplication_2)
y = ClusterOutput(neg)
R = ClusterOutput(addition_2)
